# Grasshopper definition hurdle.gh (Grasshopper 1.0.8)
# plug-ins: RhinoCodePluginGH, Bifocals

top_clip_type = ValueList({"Clip": 0, "Cap": 1}, selected="Clip")

# ----
# 4-way joint
image_resource = ImageResource("/Users/bransonlaszlo/Desktop/Screenshots/Screenshot 2024-12-11 at 10.35.16 AM.png")
brep = Brep(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)

# ----
# Hurdle Holder
image_resource_2 = ImageResource("/Users/bransonlaszlo/Desktop/Screenshots/Screenshot 2024-12-11 at 10.34.20 AM.png")
brep_2 = Brep(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)

# ----
# Bifocals Exceptions: Brep
# Image Resource
# Deconstruct
# Construct Point
# Curve
# Line
# Expression
# Move
# Area
# Volume
# Deconstruct Box
# Box
# List Item
# Deconstruct Domain
# Point
# Mirror
# List Length
# Value List
# Arf!
# Welcome to
# Dog Machine 1.0!
# Bow-wow!
# Bark!
image_resource_3 = ImageResource("/Users/bransonlaszlo/Downloads/IMG_6157.jpg")

# ----
# End cap
brep_3 = Brep(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)

# ----
# Top Rect Curve For Lofting Off Gripper
image_resource_4 = ImageResource("/Users/bransonlaszlo/Desktop/Screenshots/Screenshot 2024-12-11 at 10.49.47 AM.png")
curve = Curve(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)

# ----
# Bottom Rect Curve For Lofting Off Gripper
image_resource_5 = ImageResource("/Users/bransonlaszlo/Desktop/Screenshots/Screenshot 2024-12-11 at 10.49.41 AM.png")
curve_2 = Curve(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)

# ----
# Sidebar Cap
image_resource_6 = ImageResource("/Users/bransonlaszlo/Desktop/Screenshots/Screenshot 2024-12-13 at 10.22.09 AM.png")
brep_4 = Brep(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)

# ----
# Sidebar Clip
image_resource_7 = ImageResource("/Users/bransonlaszlo/Desktop/Screenshots/Screenshot 2024-12-11 at 10.48.23 AM.png")
brep_5 = Brep(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)

# ----
# Top Joint
image_resource_8 = ImageResource("/Users/bransonlaszlo/Desktop/Screenshots/Screenshot 2024-12-11 at 10.48.07 AM.png")
brep_6 = Brep(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)

# ----
# Get Top Joint Piece Height
box = Box(brep_6)
deconstruct_box = DeconstructBox(Box=box)  # -> Plane, X, Y, Z
number = Number(deconstruct_box.Z)
panel = Panel(number)

stream_filter = StreamFilter(Gate=top_clip_type, Stream0=brep_5, Stream1=brep_4)

# ----
# Gap between sections.
# OK fit with Bambu A1 Mini.
# Great fit with X1C.
joint_tolerance_gap_mm = Panel(".2")

# ----
# Male Joint
image_resource_9 = ImageResource("/Users/bransonlaszlo/Desktop/Screenshots/Screenshot 2024-12-12 at 9.09.28 AM.png")
brep_7 = Brep(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)

# ----
# Female Joint
# Alignment Point
# Helpful to choose a point to move from
# manually on premade geometry. Saves
# having to explode objects to access
# simple references.
image_resource_10 = ImageResource("/Users/bransonlaszlo/Desktop/Screenshots/Screenshot 2024-12-12 at 9.12.43 AM.png")
image_resource_11 = ImageResource("/Users/bransonlaszlo/Desktop/Screenshots/Screenshot 2024-12-12 at 9.10.27 AM.png")
point = Point(Point(-317.3469312, -413.6121282, 41.76604594))
brep_8 = Brep(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)

first_clip = Panel("0")

# ----
# Controls🐾
# Frame Settings
# Hurdle Holder Settings
# The above option toggles generation of an endcap that rests on
# the sidebars instead of another clip. This piece anchors the hurdle
# holders securely and prevents the apparatus from slipping down the PVC.
# 
# The clip and cap parts are interchangable.
# Bakeable Geometry!
width_cm = Slider(154, range=25..200)
side_bars_height_cm = Slider(95, range=25..200)
feet_length_cm = Slider(40, range=10..100)
minimum_jump_height_cm = Slider(36, range=8..100)
jump_stop_interval_cm = Slider(7.545, range=4.8..30)
# This parameter sets the maximum dimension of printable 3D geometry.
_3d_printer_max_lateral_dimension_mm = Slider(200, range=100..300)
# Misc.
dog_height_cm = Slider(65, range=10..100)
jump_bar_z = Slider(40, range=10..100)

# ----
# Jump Height Parameters
number_2 = Number(minimum_jump_height_cm)
number_3 = Number(jump_stop_interval_cm)
expression = Expression(x=number_2, Expression="x*10")
expression_2 = Expression(x=number_3, Expression="x*10")

# ----
# Middle Base Bar
expression_3 = Expression(x=width_cm, Expression="x*10/2")
negative = Negative(Value=expression_3)
construct_point = ConstructPoint(XCoordinate=negative, YCoordinate=0, ZCoordinate=0)
construct_point_2 = ConstructPoint(XCoordinate=expression_3, YCoordinate=0, ZCoordinate=0)

# ----
# Position 4-way joint on hurdle base
volume = Volume(Geometry=brep)  # -> Volume, Centroid
I = Slider(1, range=0..9)
explode_object = ExplodeObject(Object=brep, Recursive=False)
deconstruct = Deconstruct(Point=volume.Centroid)  # -> XComponent, YComponent, ZComponent
list_item = ListItem(List=explode_object, Index=I, Wrap=True)
x_cap_overlap = Slider(1.552, range=0..5)
area = Area(Geometry=list_item)  # -> Area, Centroid
deconstruct_2 = Deconstruct(Point=area.Centroid)  # -> XComponent, YComponent, ZComponent
subtraction = Subtraction(A=deconstruct.XComponent, B=x_cap_overlap)
construct_point_3 = ConstructPoint(XCoordinate=subtraction, YCoordinate=deconstruct_2.YComponent, ZCoordinate=deconstruct_2.ZComponent)
vector_2pt = Vector2Pt(PointA=construct_point_3, PointB=construct_point_2, Unitize=False)  # -> Vector, Length
move = Move(Geometry=brep, Motion=vector_2pt.Vector)  # -> Geometry, Transform
mirror = Mirror(Geometry=move.Geometry, Plane=PlaneYZ(0, 0, 0))  # -> Geometry, Transform
explode_object_2 = ExplodeObject(Object=move.Geometry, Recursive=False)

# ----
# Draw Hurdle Feet
number_4 = Number(feet_length_cm)
list_item_2 = ListItem(List=explode_object_2, Index=Slider(2, range=0..9), Wrap=True)
area_2 = Area(Geometry=list_item_2)  # -> Area, Centroid
feet_4_way_joint_depth_mm = Slider(10, range=10..10.001)
unit_y = UnitY(Factor=feet_4_way_joint_depth_mm)
move_2 = Move(Geometry=area_2.Centroid, Motion=unit_y)  # -> Geometry, Transform
negative_2 = Negative(Value=number_4)
unit_y_2 = UnitY(Factor=expr("x*10", negative_2))
move_3 = Move(Geometry=move_2.Geometry, Motion=unit_y_2)  # -> Geometry, Transform
line = Line(StartPoint=move_2.Geometry, EndPoint=move_3.Geometry)
xz_plane = XZPlane(Origin=Point(0, 0, 0))
mirror_2 = Mirror(Geometry=line, Plane=xz_plane)  # -> Geometry, Transform
mirror_3 = Mirror(Geometry=[mirror_2.Geometry, line], Plane=PlaneYZ(0, 0, 0))  # -> Geometry, Transform

# ----
# Cross Bar
line_2 = Line(StartPoint=construct_point, EndPoint=construct_point_2)
cross_joint_fit = Slider(-2.108, range=-10..0)
expression_4 = Expression(x=jump_bar_z, Expression="x*10")
unit_z = UnitZ(Factor=expression_4)
expression_5 = Expression(x=cross_joint_fit, Expression="x*10")
# Draw Lines for Basic Hurdle Dimensions
extend_curve = ExtendCurve(Curve=line_2, Type=0, Start=expression_5, End=expression_5)
move_4 = Move(Geometry=extend_curve, Motion=unit_z)  # -> Geometry, Transform
divide_length = DivideLength(Curve=extend_curve, Length=extend_curve)  # -> Points, Tangents, Parameters

# ----
# Position Botton Holder Based on Param
point_2 = Point(divide_length.Points)
list_item_3 = ListItem(List=point_2, Index=0, Wrap=True)
holder_x_offset = Slider(-14.878, range=-50..50)
deconstruct_3 = Deconstruct(Point=list_item_3)  # -> XComponent, YComponent, ZComponent
subtraction_2 = Subtraction(A=deconstruct_3.XComponent, B=holder_x_offset)
construct_point_4 = ConstructPoint(XCoordinate=subtraction_2, YCoordinate=deconstruct_3.YComponent, ZCoordinate=expression)
volume_2 = Volume(Geometry=brep_2)  # -> Volume, Centroid
vector_2pt_2 = Vector2Pt(PointA=volume_2.Centroid, PointB=construct_point_4, Unitize=False)  # -> Vector, Length
move_5 = Move(Geometry=brep_2, Motion=vector_2pt_2.Vector)  # -> Geometry, Transform

# ----
# Dog Helper
dog = Mesh(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)
box_part = Slider(4, range=0..5)
box_2 = Box(dog)
explode_object_3 = ExplodeObject(Object=box_2, Recursive=False)
list_item_4 = ListItem(List=explode_object_3, Index=box_part, Wrap=True)
expression_6 = Expression(x=dog_height_cm, Expression="(x/69.82)")
area_3 = Area(Geometry=list_item_4)  # -> Area, Centroid
scale = Scale(Geometry=dog, Center=area_3.Centroid, Factor=expression_6)  # -> Geometry, Transform

# ----
# Send joint-fitted endpoint to sidebars
I_2 = Slider(0, range=0..9)
list_item_5 = ListItem(List=explode_object_2, Index=I_2, Wrap=True)
area_4 = Area(Geometry=list_item_5)  # -> Area, Centroid
deconstruct_4 = Deconstruct(Point=area_4.Centroid)  # -> XComponent, YComponent, ZComponent
side_bars_4_way_jt_depth = Slider(3.034, range=0..5)
construct_point_5 = ConstructPoint(XCoordinate=deconstruct_4.XComponent, YCoordinate=0, ZCoordinate=side_bars_4_way_jt_depth)

# ----
# Side Bars
expression_7 = Expression(x=side_bars_height_cm, Expression="x*10")
unit_z_2 = UnitZ(Factor=expression_7)
move_6 = Move(Geometry=construct_point_5, Motion=unit_z_2)  # -> Geometry, Transform
line_3 = Line(StartPoint=construct_point_5, EndPoint=move_6.Geometry)
mirror_4 = Mirror(Geometry=line_3, Plane=PlaneYZ(0, 0, 0))  # -> Geometry, Transform

# ----
# Add Foot and Hurdle Bar Endcaps
number_slider = Slider(4, range=0..9)
explode_object_4 = ExplodeObject(Object=brep_3, Recursive=False)
list_item_6 = ListItem(List=explode_object_4, Index=number_slider, Wrap=True)
area_5 = Area(Geometry=list_item_6)  # -> Area, Centroid
divide_length_2 = DivideLength(Curve=move_4.Geometry, Length=move_4.Geometry)  # -> Points, Tangents, Parameters
list_item_7 = ListItem(List=divide_length_2.Points, Index=0, Wrap=True)
vector_2pt_3 = Vector2Pt(PointA=area_5.Centroid, PointB=move_3.Geometry, Unitize=False)  # -> Vector, Length
vector_2pt_4 = Vector2Pt(PointA=area_5.Centroid, PointB=list_item_7, Unitize=False)  # -> Vector, Length
move_7 = Move(Geometry=brep_3, Motion=vector_2pt_4.Vector)  # -> Geometry, Transform
move_8 = Move(Geometry=brep_3, Motion=vector_2pt_3.Vector)  # -> Geometry, Transform
explode_object_5 = ExplodeObject(Object=move_7.Geometry, Recursive=False)
explode_object_6 = ExplodeObject(Object=move_8.Geometry, Recursive=False)
list_item_8 = ListItem(List=explode_object_5, Index=Slider(4, range=0..9), Wrap=True)
list_item_9 = ListItem(List=explode_object_6, Index=Slider(4, range=0..9), Wrap=True)
area_6 = Area(Geometry=list_item_8)  # -> Area, Centroid
area_7 = Area(Geometry=list_item_9)  # -> Area, Centroid
rotate_direction = RotateDirection(Geometry=move_7.Geometry, Center=area_6.Centroid, From=Vector(1, 0, 0), To=Vector(0, 1, 0))  # -> Geometry, Transform
unit_y_3 = UnitY(Factor=-1)
rotate_direction_2 = RotateDirection(Geometry=move_8.Geometry, Center=area_7.Centroid, From=unit_y_3, To=Vector(0, 1, 0))  # -> Geometry, Transform
xz_plane_2 = XZPlane(Origin=Point(0, 0, 0))
mirror_5 = Mirror(Geometry=rotate_direction_2.Geometry, Plane=xz_plane_2)  # -> Geometry, Transform
mirror_6 = Mirror(Geometry=[mirror_5.Geometry, rotate_direction_2.Geometry, rotate_direction.Geometry], Plane=PlaneYZ(0, 0, 0))  # -> Geometry, Transform

# ----
# Add Top Endcaps
brep_9 = Brep(brep_3)
volume_3 = Volume(Geometry=brep_9)  # -> Volume, Centroid
deconstruct_5 = Deconstruct(Point=volume_3.Centroid)  # -> XComponent, YComponent, ZComponent
addition = Addition(A=deconstruct_5.XComponent, B=1)
construct_point_6 = ConstructPoint(XCoordinate=addition, YCoordinate=deconstruct_5.YComponent, ZCoordinate=deconstruct_5.ZComponent)
line_4 = Line(StartPoint=volume_3.Centroid, EndPoint=construct_point_6)
rotate_axis = RotateAxis(Geometry=brep_9, Angle=1.570796327, Axis=line_4)  # -> Geometry, Transform
explode_object_7 = ExplodeObject(Object=rotate_axis.Geometry, Recursive=False)
list_item_10 = ListItem(List=explode_object_7, Index=Slider(4, range=0..9), Wrap=True)
area_8 = Area(Geometry=list_item_10)  # -> Area, Centroid
vector_2pt_5 = Vector2Pt(PointA=area_8.Centroid, PointB=move_6.Geometry, Unitize=False)  # -> Vector, Length
move_9 = Move(Geometry=rotate_axis.Geometry, Motion=vector_2pt_5.Vector)  # -> Geometry, Transform
mirror_7 = Mirror(Geometry=move_9.Geometry, Plane=PlaneYZ(0, 0, 0))  # -> Geometry, Transform

# ----
# Printer Dimensional Constraint
max_lateral_dimension_mm = Panel(_3d_printer_max_lateral_dimension_mm)

# ----
# Topmost Point
divide_length_3 = DivideLength(Curve=mirror_4.Geometry, Length=mirror_4.Geometry)  # -> Points, Tangents, Parameters
# Frame Generation
list_item_11 = ListItem(List=divide_length_3.Points, Index=1, Wrap=True)

# ----
# Calculate all Hurdle Holder Z Positions
# Top Point Left Sidebar
# Beginning at Z == minimum jump height, increase by stop interval
# until last piece that fits at max (top of side bars minus cap)
top_cap_offset = Slider(50, range=0..200)
deconstruct_6 = Deconstruct(Point=list_item_11)  # -> XComponent, YComponent, ZComponent
subtraction_3 = Subtraction(A=deconstruct_6.ZComponent, B=top_cap_offset)
expression_8 = Expression(x=expression, y=expression_2, z=subtraction_3, Expression="int((z-x)/y) + 1")
series = Series(Start=expression, Step=expression_2, Count=expression_8)

# ----
# Hurdle Stop Z Heights
construct_point_7 = ConstructPoint(XCoordinate=deconstruct_6.XComponent, YCoordinate=deconstruct_6.YComponent, ZCoordinate=series)

# ----
# Move hurdle holders to calculated Z positions
volume_4 = Volume(Geometry=move_5.Geometry)  # -> Volume, Centroid
deconstruct_7 = Deconstruct(Point=construct_point_7)  # -> XComponent, YComponent, ZComponent
deconstruct_8 = Deconstruct(Point=volume_4.Centroid)  # -> XComponent, YComponent, ZComponent
construct_point_8 = ConstructPoint(XCoordinate=deconstruct_8.XComponent, YCoordinate=deconstruct_8.YComponent, ZCoordinate=deconstruct_7.ZComponent)
vector_2pt_6 = Vector2Pt(PointA=volume_4.Centroid, PointB=construct_point_8, Unitize=False)  # -> Vector, Length
move_10 = Move(Geometry=move_5.Geometry, Motion=vector_2pt_6.Vector)  # -> Geometry, Transform

# ----
# Position Top Joint
# Moving pre-positioned
# geometry all at once
# to preserve relative distances
volume_5 = Volume(Geometry=brep_6)  # -> Volume, Centroid
hurdle_grip_x_offset = Slider(13.889, range=0..100)
deconstruct_9 = Deconstruct(Point=volume_5.Centroid)  # -> XComponent, YComponent, ZComponent
addition_2 = Addition(A=deconstruct_9.XComponent, B=hurdle_grip_x_offset)
construct_point_9 = ConstructPoint(XCoordinate=addition_2, YCoordinate=deconstruct_9.YComponent, ZCoordinate=deconstruct_9.ZComponent)
list_item_12 = ListItem(List=reverse(construct_point_8), Index=0, Wrap=True)
vector_2pt_7 = Vector2Pt(PointA=construct_point_9, PointB=list_item_12, Unitize=False)  # -> Vector, Length
move_11 = Move(Geometry=[brep_6, curve_2, curve, stream_filter], Motion=vector_2pt_7.Vector)  # -> Geometry, Transform

# ----
# Get max section length minus joint length
image_resource_12 = ImageResource("/Users/bransonlaszlo/Desktop/Screenshots/Screenshot 2024-12-11 at 11.36.41 AM.png")
joint_length = Panel("21.77")
subtraction_4 = Subtraction(A=max_lateral_dimension_mm, B=joint_length)
negative_3 = Negative(Value=subtraction_4)
unit_z_3 = UnitZ(Factor=negative_3)

# ----
# Pipe Curves
expression_9 = Expression(Expression="33.5/2")
line_5 = Line(flatten([line_3, move_4.Geometry, mirror_4.Geometry, line, mirror_2.Geometry, mirror_3.Geometry, extend_curve]))
pipe = Pipe(Curve=line_5, Radius=expression_9, Caps=0)
line_6 = Line(flatten(line_5))
brep_10 = Brep(flatten(pipe))
length = Length(Curve=line_6)
sort_list = SortList(Keys=length, ValuesValuesA=brep_10)  # -> Keys, ValuesValuesA
list_item_13 = ListItem(List=sort_list.ValuesValuesA, Index=Slider(0, range=0..7), Wrap=True)

# ----
# Calculate remaining length of topmost piece
# according to max lateral dimension param
expression_10 = Expression(x=max_lateral_dimension_mm, y=panel, z=joint_length, Expression="x-y-z")
negative_4 = Negative(Value=expression_10)
unit_z_4 = UnitZ(Factor=negative_4)

# ----
# Get Bottommost Hurdle Holder Min Z
list_item_14 = ListItem(List=move_10.Geometry, Index=0, Wrap=True)
box_3 = Box(list_item_14)
deconstruct_box_2 = DeconstructBox(Box=box_3)  # -> Plane, X, Y, Z
deconstruct_domain = DeconstructDomain(Domain=deconstruct_box_2.Z)  # -> Start, End

# ----
# Grab each individual geometry
# Plate w/Female Joint
# Bottom Rectangular Curve
# Sidebar Clip
number_slider_2 = Slider(3, range=0..3)
blerpper = ListItem(List=move_11.Geometry, Index=0, Wrap=True)
list_item_15 = ListItem(List=move_11.Geometry, Index=Slider(1, range=0..3), Wrap=True)
list_item_16 = ListItem(List=move_11.Geometry, Index=number_slider_2, Wrap=True)

# ----
# Loft Remainder of Top Section, Union
surface = Surface(list_item_15)
move_12 = Move(Geometry=surface, Motion=unit_z_4)  # -> Geometry, Transform
loft = Loft(
    Curves=[surface, move_12.Geometry],
    Options={Adjust=False, Closed=False, LoftEnds=0, LoftSimp=0, LoftType=0, Rebuild=10, Refit=0.01})
cap_holes = CapHoles(Brep=loft)
merge = Merge(Data1=blerpper, Data2=cap_holes)
solid_union = SolidUnion(Breps=merge)
merge_faces = MergeFaces(Brep=solid_union)  # -> Breps, Before, After
brep_11 = Brep(merge_faces.Breps)

# ----
# Move rect to top of next section
# according to tolerance gap.
negative_5 = Negative(Value=joint_tolerance_gap_mm)
unit_z_5 = UnitZ(Factor=negative_5)
move_13 = Move(Geometry=move_12.Geometry, Motion=unit_z_5)  # -> Geometry, Transform
area_9 = Area(Geometry=move_13.Geometry)  # -> Area, Centroid

# ----
# Materials List Placement
additional_parts_z_offset = Slider(10, range=0..50)
unit_z_6 = UnitZ(Factor=expr("-x*10", additional_parts_z_offset))
panel_2 = Panel(expression_9)

# ----
# Arrange Parted Pipes with Dimensions
python_3_script = Python3Script(x=sort_list.Keys, y=sort_list.ValuesValuesA)  # -> lengths, quantities; inputs x: list, y: list
# ---------- python_3_script: Python ----------
"""Grasshopper Script"""
a = "Hello Python 3 in Grasshopper!"
print(a)

myLines = dict.fromkeys(x, 0)

for line in x:
    myLines[line] += 1



lengths = list(myLines.keys())

for key in lengths:
    myLines[key] = "x " + str(myLines[key])

quantities = list(myLines.values())
# ---------- end python_3_script ----------
panel_3 = Panel(python_3_script.lengths)
panel_4 = Panel(python_3_script.quantities)
list_length = ListLength(List=panel_3)
series_2 = Series(Start=expr("x*10", Slider(245, range=0..800)), Step=expr("x*10", Slider(-59, range=-100..50)), Count=list_length)
construct_point_10 = ConstructPoint(XCoordinate=series_2, YCoordinate=0, ZCoordinate=panel_3)
construct_point_11 = ConstructPoint(XCoordinate=series_2, YCoordinate=0, ZCoordinate=0)
list_item_17 = ListItem(List=construct_point_11, Index=0, Wrap=True)
line_7 = Line(StartPoint=construct_point_11, EndPoint=construct_point_10)
pipe_2 = Pipe(Curve=line_7, Radius=panel_2, Caps=0)
divide_length_4 = DivideLength(Curve=line_7, Length=expr("x/2", line_7))  # -> Points, Tangents, Parameters
text_size = Slider(0.534, range=-0.001..1)
list_item_18 = ListItem(List=divide_length_4.Points, Index=1, Wrap=True)
text_x_offset = Slider(12, range=0..55)
text_size_2 = Slider(0.523, range=-0.001..1)
unit_z_7 = UnitZ(Factor=1)
annotation_dimension_settings = AnnotationDimensionSettings(ExtensionLineOffset=Slider(0.542, range=-2..2))  # -> DimensionSettings, ViewOriented, TextLocation, TextRotation, RadialViewOriented, RadialTextLocation, RadialTextRotation, DimensionLineExtension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
unit_x = UnitX(Factor=expr("-x*10", Slider(15, range=0..15)))
construct_plane = ConstructPlane(Origin=list_item_18, XAxis=Vector(1, 0, 0), YAxis=unit_z_7)  # -> flatten(Plane)
unit_x_2 = UnitX(Factor=expr("x*10", text_x_offset))
annotation_text_settings = AnnotationTextSettings(TextHeight=text_size_2, HorizontalAlignment=1, VerticalAlignment=3)
annotation_text_settings_2 = AnnotationTextSettings(TextHeight=text_size, HorizontalAlignment=1, VerticalAlignment=3)
text = Text(panel_4)
move_14 = Move(Geometry=line_7, Motion=unit_x)  # -> Geometry, Transform
move_15 = Move(Geometry=construct_plane, Motion=unit_x_2)  # -> Geometry, Transform
plan_units = ValueList({"Centimeters": 4, "Inches": 7}, selected="Centimeters")
text_entity = TextEntity(Plane=move_15.Geometry, Text=text, TextSettings=annotation_text_settings_2)  # -> TextEntity, Plane, Text, TextSettings
annotation_units_settings = AnnotationUnitsSettings(LengthUnitsFormat=plan_units)  # -> UnitsSettings, LengthUnitsFormat, LengthFactor, LinearResolution, Roundoff, Prefix, Suffix, ZeroSuppression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
linear_dimension = LinearDimension(
    BaseLine=move_14.Geometry,
    PointA=construct_point_11,
    PointB=construct_point_10,
    TextSettings=annotation_text_settings,
    DimensionSettings=annotation_dimension_settings.DimensionSettings,
    UnitsSettings=annotation_units_settings.UnitsSettings)  # -> LinearDimension, BaseLine, PointA, PointB, TextOverride, TextSettings, DimensionSettings, ArrowSettings, UnitsSettings, ToleranceSettings

# ----
# Position 4-way Joint for Parts List
volume_6 = Volume(Geometry=brep)  # -> Volume, Centroid
subtraction_5 = Subtraction(A=volume_6.Centroid, B=unit_z_6)
vector_2pt_8 = Vector2Pt(PointA=subtraction_5, PointB=list_item_17, Unitize=False)  # -> Vector, Length
move_16 = Move(Geometry=brep, Motion=vector_2pt_8.Vector)  # -> Geometry, Transform
volume_7 = Volume(Geometry=move_16.Geometry)  # -> Volume, Centroid
unit_z_8 = UnitZ(Factor=expr("-x", 1))
unit_z_9 = UnitZ(Factor=1)
text_x_offset_2 = Slider(100, range=0..100)
construct_plane_2 = ConstructPlane(Origin=volume_7.Centroid, XAxis=Vector(1, 0, 0), YAxis=unit_z_9)  # -> flatten(Plane)
text_size_3 = Slider(0.523, range=-0.001..1)
subtraction_6 = Subtraction(A=volume_7.Centroid, B=unit_z_8)
unit_x_3 = UnitX(Factor=text_x_offset_2)
line_8 = Line(StartPoint=volume_7.Centroid, EndPoint=subtraction_6)
annotation_text_settings_3 = AnnotationTextSettings(TextHeight=text_size_3, HorizontalAlignment=1, VerticalAlignment=3)
move_17 = Move(Geometry=construct_plane_2, Motion=unit_x_3)  # -> Geometry, Transform
rotate_axis_2 = RotateAxis(Geometry=move_16.Geometry, Angle=-2.356194, Axis=line_8)  # -> Geometry, Transform
text_entity_2 = TextEntity(Plane=move_17.Geometry, Text="x 2", TextSettings=annotation_text_settings_3)  # -> TextEntity, Plane, Text, TextSettings

# ----
# Position endcap for Parts List
volume_8 = Volume(Geometry=brep_3)  # -> Volume, Centroid
list_item_19 = ListItem(List=construct_point_11, Index=1, Wrap=True)
subtraction_7 = Subtraction(A=volume_8.Centroid, B=unit_z_6)
vector_2pt_9 = Vector2Pt(PointA=subtraction_7, PointB=list_item_19, Unitize=False)  # -> Vector, Length
move_18 = Move(Geometry=brep_3, Motion=vector_2pt_9.Vector)  # -> Geometry, Transform
volume_9 = Volume(Geometry=move_18.Geometry)  # -> Volume, Centroid
unit_z_10 = UnitZ(Factor=1)
unit_z_11 = UnitZ(Factor=expr("-x", 1))
text_x_offset_3 = Slider(100, range=0..100)
construct_plane_3 = ConstructPlane(Origin=volume_9.Centroid, XAxis=Vector(1, 0, 0), YAxis=unit_z_10)  # -> flatten(Plane)
subtraction_8 = Subtraction(A=volume_9.Centroid, B=unit_z_11)
text_size_4 = Slider(0.523, range=-0.001..1)
unit_x_4 = UnitX(Factor=text_x_offset_3)
line_9 = Line(StartPoint=volume_9.Centroid, EndPoint=subtraction_8)
annotation_text_settings_4 = AnnotationTextSettings(TextHeight=text_size_4, HorizontalAlignment=1, VerticalAlignment=3)
move_19 = Move(Geometry=construct_plane_3, Motion=unit_x_4)  # -> Geometry, Transform
rotate_axis_3 = RotateAxis(Geometry=move_18.Geometry, Angle=-2.356194, Axis=line_9)  # -> Geometry, Transform
text_entity_3 = TextEntity(Plane=move_19.Geometry, Text="x 8", TextSettings=annotation_text_settings_4)  # -> TextEntity, Plane, Text, TextSettings

# ----
# Printable Geometry Generation
# Series of lofted rects downwards.
# -Must fit within printer bounds
# -Including length of male joint
expression_11 = Expression(x=joint_tolerance_gap_mm, y=max_lateral_dimension_mm, z=joint_length, Expression="x+y-z")
number_5 = Number(deconstruct_domain.Start)

# ----
# Use new rect Z to begin series of
# rects to act as top surfaces
# of lofted sections.
deconstruct_10 = Deconstruct(Point=area_9.Centroid)  # -> XComponent, YComponent, ZComponent
expression_12 = Expression(x=expression_11, y=deconstruct_10.ZComponent, z=number_5, Expression="(y-z)/x")
expression_13 = Expression(x=expression_12, Expression="int(x)")
negative_6 = Negative(Value=expression_11)
series_3 = Series(Start=deconstruct_10.ZComponent, Step=negative_6, Count=expression_13)
construct_point_12 = ConstructPoint(XCoordinate=deconstruct_10.XComponent, YCoordinate=deconstruct_10.YComponent, ZCoordinate=series_3)
vector_2pt_10 = Vector2Pt(PointA=area_9.Centroid, PointB=construct_point_12, Unitize=False)  # -> Vector, Length
move_20 = Move(Geometry=move_13.Geometry, Motion=vector_2pt_10.Vector)  # -> Geometry, Transform

# ----
# Loft remaining regular sections
move_21 = Move(Geometry=move_20.Geometry, Motion=unit_z_3)  # -> graft(Geometry), Transform
merge_2 = Merge(Data1=graft(move_20.Geometry), Data2=move_21.Geometry)
loft_2 = Loft(Curves=merge_2, Options={Adjust=False, Closed=False, LoftEnds=0, LoftSimp=0, LoftType=0, Rebuild=10, Refit=0.01})
cap_holes_2 = CapHoles(Brep=loft_2)

# ----
# Build Bottom Section
list_length_2 = ListLength(List=flatten(move_21.Geometry))
expression_14 = Expression(x=list_length_2, Expression="x-1")
list_item_20 = ListItem(List=flatten(move_21.Geometry), Index=expression_14, Wrap=True)
move_22 = Move(Geometry=list_item_20, Motion=unit_z_5)  # -> Geometry, Transform
area_10 = Area(Geometry=move_22.Geometry)  # -> Area, Centroid
bottom_plate_offset = Slider(16, range=0..100)
deconstruct_11 = Deconstruct(Point=area_10.Centroid)  # -> XComponent, YComponent, ZComponent
internal_joint_minimum_height = Panel("45")
subtraction_9 = Subtraction(A=number_5, B=bottom_plate_offset)
subtraction_10 = Subtraction(A=deconstruct_11.ZComponent, B=internal_joint_minimum_height)
minimum = Minimum(A=subtraction_9, B=subtraction_10)
construct_point_13 = ConstructPoint(XCoordinate=deconstruct_11.XComponent, YCoordinate=deconstruct_11.YComponent, ZCoordinate=minimum)
vector_2pt_11 = Vector2Pt(PointA=area_10.Centroid, PointB=construct_point_13, Unitize=False)  # -> Vector, Length
move_23 = Move(Geometry=move_22.Geometry, Motion=vector_2pt_11.Vector)  # -> Geometry, Transform
merge_3 = Merge(Data1=move_22.Geometry, Data2=move_23.Geometry)  # -> flatten(Result)
loft_3 = Loft(Curves=merge_3, Options={Adjust=False, Closed=False, LoftEnds=0, LoftSimp=0, LoftType=0, Rebuild=10, Refit=0.01})
cap_holes_3 = CapHoles(Brep=loft_3)

# ----
# Rect Bottoms
merge_4 = Merge(Data1=flatten(move_12.Geometry), Data2=flatten(move_21.Geometry))

# ----
# Position Male Joints
number_slider_3 = Slider(78, range=0..81)
explode_object_8 = ExplodeObject(Object=brep_7, Recursive=False)
list_item_21 = ListItem(List=explode_object_8, Index=number_slider_3, Wrap=True)
deconstruct_brep = DeconstructBrep(Brep=list_item_21)  # -> Faces, Edges, Vertices
area_11 = Area(Geometry=merge_4)  # -> Area, Centroid
deconstruct_brep_2 = DeconstructBrep(Brep=merge_4)  # -> Faces, Edges, Vertices
list_item_22 = ListItem(List=deconstruct_brep.Edges, Index=Slider(5, range=0..5), Wrap=True)
divide_length_5 = DivideLength(Curve=list_item_22, Length=expr("x/2", list_item_22))  # -> Points, Tangents, Parameters
list_item_23 = ListItem(List=deconstruct_brep_2.Edges, Index=Slider(3, range=0..3), Wrap=True)
list_item_24 = ListItem(List=divide_length_5.Points, Index=Slider(1, range=0..2), Wrap=True)
divide_length_6 = DivideLength(Curve=list_item_23, Length=expr("x/2", list_item_23))  # -> Points, Tangents, Parameters
list_item_25 = ListItem(List=divide_length_6.Points, Index=Slider(1, range=0..2), Wrap=True)
vector_2pt_12 = Vector2Pt(PointA=list_item_24, PointB=list_item_25, Unitize=False)  # -> Vector, Length
move_24 = Move(Geometry=brep_7, Motion=vector_2pt_12.Vector)  # -> flatten(Geometry), Transform

# ----
# Rect Tops (Regular)
merge_5 = Merge(Data1=flatten(move_20.Geometry), Data2=flatten(move_22.Geometry))

# ----
# Position Female Joints
number_slider_4 = Slider(3, range=0..3)
deconstruct_brep_3 = DeconstructBrep(Brep=merge_5)  # -> Faces, Edges, Vertices
list_item_26 = ListItem(List=deconstruct_brep_3.Edges, Index=number_slider_4, Wrap=True)
divide_length_7 = DivideLength(Curve=list_item_26, Length=expr("x/2", list_item_26))  # -> Points, Tangents, Parameters
list_item_27 = ListItem(List=divide_length_7.Points, Index=Slider(1, range=0..2), Wrap=True)
vector_2pt_13 = Vector2Pt(PointA=point, PointB=flatten(list_item_27), Unitize=False)  # -> Vector, Length
move_25 = Move(Geometry=graft(brep_8), Motion=vector_2pt_13.Vector)  # -> Geometry, Transform

# ----
# All Wall Pieces Here!
merge_6 = Merge(Data1=flatten(brep_11), Data2=flatten(cap_holes_2), Data3=cap_holes_3)

# ----
# Chamfer Edges
panel_5 = Panel("1")
split_list = SplitList(List=merge_6, Index=panel_5)  # -> ListA, ListB
list_length_3 = ListLength(List=split_list.ListB)
expression_15 = Expression(x=list_length_3, Expression="x-1")
deconstruct_brep_4 = DeconstructBrep(Brep=split_list.ListA)  # -> Faces, Edges, Vertices
split_list_2 = SplitList(List=split_list.ListB, Index=expression_15)  # -> ListA, ListB
number_slider_5 = Slider(325, range=0..325)
number_slider_6 = Slider(324, range=0..325)
number_slider_7 = Slider(6, range=0..325)
list_item_28 = ListItem(List=deconstruct_brep_4.Edges, Index=number_slider_7, Wrap=True)
list_item_29 = ListItem(List=deconstruct_brep_4.Edges, Index=number_slider_6, Wrap=True)
deconstruct_brep_5 = DeconstructBrep(Brep=split_list_2.ListB)  # -> Faces, Edges, Vertices
list_item_30 = ListItem(List=deconstruct_brep_4.Edges, Index=number_slider_5, Wrap=True)
deconstruct_brep_6 = DeconstructBrep(Brep=split_list_2.ListA)  # -> Faces, simplify(Edges), Vertices
number_slider_8 = Slider(10, range=0..11)
number_slider_9 = Slider(4, range=0..11)
number_slider_10 = Slider(11, range=0..11)
fillet_edge = FilletEdge(
    Shape=split_list.ListA,
    Blend=1,
    Metric=0,
    Edges=[number_slider_5, number_slider_6, number_slider_7],
    Radii=Slider(1.39, range=0..10))  # -> flatten(Result)
number_slider_11 = Slider(10, range=0..11)
number_slider_12 = Slider(11, range=0..11)
list_item_31 = ListItem(List=deconstruct_brep_5.Edges, Index=number_slider_9, Wrap=True)
list_item_32 = ListItem(List=deconstruct_brep_5.Edges, Index=number_slider_8, Wrap=True)
list_item_33 = ListItem(List=deconstruct_brep_5.Edges, Index=number_slider_10, Wrap=True)
list_item_34 = ListItem(List=deconstruct_brep_6.Edges, Index=number_slider_11, Wrap=True)
list_item_35 = ListItem(List=deconstruct_brep_6.Edges, Index=number_slider_12, Wrap=True)
fillet_edge_2 = FilletEdge(
    Shape=split_list_2.ListB,
    Blend=1,
    Metric=0,
    Edges=[number_slider_10, number_slider_8, number_slider_9],
    Radii=Slider(1.39, range=0..10))  # -> flatten(Result)
fillet_edge_3 = FilletEdge(
    Shape=simplify(graft(split_list_2.ListA)),
    Blend=1,
    Metric=0,
    Edges=[number_slider_12, number_slider_11],
    Radii=Slider(1.39, range=0..10))  # -> flatten(Result)
merge_7 = Merge(Data1=fillet_edge, Data2=fillet_edge_3, Data3=fillet_edge_2)

# ----
# Position Clips
# Sidebar clip alignment point
number_slider_13 = Slider(3, range=0..47)
box_4 = Box(move_24.Geometry)
deconstruct_brep_7 = DeconstructBrep(Brep=box_4)  # -> Faces, Edges, Vertices
list_item_36 = ListItem(List=deconstruct_brep_7.Edges, Index=number_slider_13, Wrap=True)
point_3 = Point(Point(-56.11271454, -779.6336731, 47.53862199))
curve_middle = CurveMiddle(Curve=list_item_36)
brep_12 = Brep(brep_5)
vector_2pt_14 = Vector2Pt(PointA=point_3, PointB=curve_middle, Unitize=False)  # -> Vector, Length
move_26 = Move(Geometry=brep_12, Motion=vector_2pt_14.Vector)  # -> Geometry, Transform
merge_8 = Merge(Data1=flatten(list_item_16), Data2=flatten(move_26.Geometry))

list_length_4 = ListLength(List=merge_7)
expression_16 = Expression(x=list_length_4, Expression="x-1")
split_list_3 = SplitList(List=merge_7, Index=expression_16)  # -> ListA, ListB

# ----
# Union Male Joints to Rects
merge_9 = Merge(Data1=simplify(graft(split_list_3.ListA)), Data2=simplify(graft(move_24.Geometry)))
solid_union_2 = SolidUnion(Breps=merge_9)  # -> simplify(Result)
merge_10 = Merge(Data1=flatten(solid_union_2), Data2=flatten(split_list_3.ListB))

# ----
# Carve Female Joints
panel_6 = Panel("1")
split_list_4 = SplitList(List=merge_10, Index=panel_6)  # -> ListA, ListB
solid_difference = SolidDifference(BrepsA=simplify(graft(split_list_4.ListB)), BrepsB=simplify(graft(move_25.Geometry)))
merge_11 = Merge(Data1=flatten(split_list_4.ListA), Data2=flatten(solid_difference))

# ----
# Split Hurdle Holders Over Section Gaps
# This block splits any hurdle holders positioned over a gap between rectangular sections.
# The Python script groups Breps together according to the Z domain of the sections (disregarding male joint pieces).
# Each group is then unioned together.
# 
# This step is necessary because of the (perhaps unideal) order in which I generated hurdle holding geometry.
# If I took another pass at this project, I would loft the full-length rectangular geometry and
# add holders *before* splitting up the sections and adding joints.
merge_12 = Merge(Data1=simplify(graft(merge_4)), Data2=simplify(graft(merge_5)))
loft_4 = Loft(Curves=merge_12, Options={Adjust=False, Closed=False, LoftEnds=0, LoftSimp=0, LoftType=0, Rebuild=10, Refit=0.01})
box_5 = Box(merge_6)
cap_holes_4 = CapHoles(Brep=loft_4)
deconstruct_box_3 = DeconstructBox(Box=box_5)  # -> Plane, X, Y, Z
volume_10 = Volume(Geometry=cap_holes_4)  # -> Volume, Centroid
number_6 = Number(deconstruct_box_3.Z)
brep_13 = Brep(move_10.Geometry)
scale_nu = ScaleNU(Geometry=cap_holes_4, Plane=volume_10.Centroid, ScaleX=Slider(9, range=0..10), ScaleY=1, ScaleZ=1)  # -> Geometry, Transform
solid_difference_2 = SolidDifference(BrepsA=flatten(brep_13), BrepsB=flatten(scale_nu.Geometry))
python_3_script_2 = Python3Script(holders=solid_difference_2, section=merge_11, sectionHeight=number_6)  # -> out, groupedSections, test; inputs holders: list of Brep, section: Brep
# ---------- python_3_script_2: Python ----------
"""Grasshopper Script"""
import rhinoscriptsyntax as rs

box = section.GetBoundingBox(True)
maxZ = box.Max[2]
minZ = maxZ - sectionHeight # Unfortunately, I backed myself into a corner with the order I generated my geometry. I am attempting to get the Z-domain of the inward faces of the scaffolds/holders. But because I have already added the male joints to the parts, the bounding box extended beyond what I needed, and I had to get creative. 
groupedSections = [section]
print(minZ, maxZ)
for holder in holders:
    centroidZ = rs.SurfaceVolumeCentroid(holder)[0][2]
    print(centroidZ)
    if (centroidZ >= minZ) and (centroidZ <= maxZ):
        groupedSections.append(holder)
# ---------- end python_3_script_2 ----------
panel_7 = Panel(python_3_script_2.groupedSections)
brep_14 = Brep(python_3_script_2.groupedSections)
solid_union_3 = SolidUnion(Breps=simplify(brep_14))

# ----
# Add Assembly Numbers
# This callback to L2 is extremely useful.
# I guess I’m better at Grasshopper now,
# because it was easy.
list_length_5 = ListLength(List=flatten(solid_union_3))
series_4 = Series(Start="1", Step=1, Count=list_length_5)
expression_17 = Expression(x=series_4, Expression="x-1")
list_item_37 = ListItem(List=flatten(solid_union_3), Index=expression_17, Wrap=True)
box_6 = Box(list_item_37)
deconstruct_box_4 = DeconstructBox(Box=box_6)  # -> Plane, X, Y, Z
deconstruct_domain_2 = DeconstructDomain(Domain=deconstruct_box_4.Y)  # -> Start, End
deconstruct_domain_3 = DeconstructDomain(Domain=deconstruct_box_4.Z)  # -> Start, End
deconstruct_domain_4 = DeconstructDomain(Domain=deconstruct_box_4.X)  # -> Start, End
construct_point_14 = ConstructPoint(XCoordinate=deconstruct_domain_4.Start, YCoordinate=deconstruct_domain_2.Start, ZCoordinate=deconstruct_domain_3.End)
construct_point_15 = ConstructPoint(XCoordinate=deconstruct_domain_4.Start, YCoordinate=deconstruct_domain_2.End, ZCoordinate=deconstruct_domain_3.End)
line_10 = Line(StartPoint=construct_point_15, EndPoint=construct_point_14)  # -> simplify(graft(Line))
move_27 = Move(Geometry=line_10, Motion=Vector(0, 0, 10))  # -> simplify(graft(Geometry)), Transform
unit_z_12 = UnitZ(Factor=Slider(-11, range=-100..0))
loft_5 = Loft(
    Curves=[move_27.Geometry, line_10],
    Options={Adjust=False, Closed=False, LoftEnds=0, LoftSimp=0, LoftType=0, Rebuild=10, Refit=0.01})  # -> flatten(Loft)
move_28 = Move(Geometry=line_10, Motion=unit_z_12)  # -> Geometry, Transform
text_on_surface = TextOnSurface(
    Text=series_4,
    Font="Sans Bold:no Italic:no",
    Height=Slider(5.7, range=0..10),
    Depth=Slider(4.111, range=0..10),
    BaseLine=flatten(move_28.Geometry),
    BaseSurface=loft_5)  # -> simplify(Symbols)

# ----
# Final Generated Geometry
brep_15 = Brep(merge_8)
list_length_6 = ListLength(List=brep_15)
solid_difference_3 = SolidDifference(BrepsA=solid_union_3, BrepsB=text_on_surface)  # -> flatten(Result)
mirror_8 = Mirror(Geometry=brep_15, Plane=PlaneYZ(0, 0, 0))  # -> Geometry, Transform
mirror_9 = Mirror(Geometry=solid_difference_3, Plane=PlaneYZ(0, 0, 0))  # -> Geometry, Transform
list_length_7 = ListLength(List=flatten(solid_difference_3))
expression_18 = Expression(x=list_length_6, Expression="x*2")
expression_19 = Expression(x=list_length_7, Expression="x*2")

point_4 = Point(Point(1400.475591, -500.5189917, 0))
box_7 = Box(solid_difference_3)
deconstruct_12 = Deconstruct(Point=point_4)  # -> XComponent, YComponent, ZComponent
deconstruct_box_5 = DeconstructBox(Box=box_7)  # -> Plane, X, Y, Z
deconstruct_domain_5 = DeconstructDomain(Domain=deconstruct_box_5.Z)  # -> Start, End
deconstruct_domain_6 = DeconstructDomain(Domain=deconstruct_box_5.X)  # -> Start, End
construct_point_16 = ConstructPoint(XCoordinate=deconstruct_domain_6.Start, YCoordinate=0, ZCoordinate=deconstruct_domain_5.End)
construct_point_17 = ConstructPoint(XCoordinate=deconstruct_domain_6.Start, YCoordinate=0, ZCoordinate=deconstruct_domain_5.Start)
line_11 = Line(StartPoint=construct_point_16, EndPoint=construct_point_17)
x_spacing = Slider(52, range=45..90)
construct_point_18 = ConstructPoint(XCoordinate=deconstruct_domain_6.End, YCoordinate=0, ZCoordinate=deconstruct_domain_5.End)
rotate_axis_4 = RotateAxis(Geometry=solid_difference_3, Angle=1.570796327, Axis=line_11)  # -> Geometry, Transform
series_5 = Series(Start=0, Step=x_spacing, Count=list_length_7)
line_12 = Line(StartPoint=construct_point_16, EndPoint=construct_point_18)
expression_20 = Expression(x1=deconstruct_12.XComponent, x2=series_5, Expression="x1+x2")
rotate_axis_5 = RotateAxis(Geometry=rotate_axis_4.Geometry, Angle=-1.570796327, Axis=line_12)  # -> Geometry, Transform
construct_point_19 = ConstructPoint(XCoordinate=expression_20, YCoordinate=deconstruct_12.YComponent, ZCoordinate=deconstruct_12.ZComponent)
vector_2pt_15 = Vector2Pt(PointA=construct_point_16, PointB=construct_point_19, Unitize=False)  # -> Vector, Length
move_29 = Move(Geometry=rotate_axis_5.Geometry, Motion=vector_2pt_15.Vector)  # -> Geometry, Transform
lr_parts_gap = Slider(20, range=0..50)
group = Group(Geometry=move_29.Geometry)
box_8 = Box(group)
deconstruct_box_6 = DeconstructBox(Box=box_8)  # -> Plane, X, Y, Z
number_7 = Number(deconstruct_box_6.X)
expression_21 = Expression(x=number_7, gap=lr_parts_gap, Expression="x+gap")

# ----
# Add Top Section Label 1
split_list_5 = SplitList(List=move_29.Geometry, Index=1)  # -> ListA, ListB
box_9 = Box(split_list_5.ListA)
deconstruct_box_7 = DeconstructBox(Box=box_9)  # -> Plane, X, Y, Z
z_offset = Slider(10.466, range=0..50)
y_offset = Slider(-5.116, range=-30..0)
deconstruct_domain_7 = DeconstructDomain(Domain=deconstruct_box_7.Y)  # -> Start, End
deconstruct_domain_8 = DeconstructDomain(Domain=deconstruct_box_7.X)  # -> Start, End
expression_22 = Expression(offset=y_offset, y=deconstruct_domain_7.End, Expression="y+offset")
construct_point_20 = ConstructPoint(XCoordinate=deconstruct_domain_8.Start, YCoordinate=expression_22, ZCoordinate=z_offset)
construct_point_21 = ConstructPoint(XCoordinate=deconstruct_domain_8.End, YCoordinate=expression_22, ZCoordinate=z_offset)
line_13 = Line(StartPoint=construct_point_20, EndPoint=construct_point_21)
text_depth = Slider(2.129, range=0..4)
text_size_5 = Slider(3.45, range=1..5)
unit_y_4 = UnitY(Factor="-1")
extrude = Extrude(Base=line_13, Direction=unit_y_4)
text_on_surface_2 = TextOnSurface(
    Text="LASZLO MMXXIV",
    Font="Arial Bold:yes Italic:no",
    Height=text_size_5,
    Depth=text_depth,
    BaseLine=line_13,
    BaseSurface=extrude)
merge_13 = Merge(Data1=split_list_5.ListA, Data2=text_on_surface_2)
solid_union_4 = SolidUnion(Breps=flatten(merge_13))
merge_14 = Merge(Data1=solid_union_4, Data2=split_list_5.ListB)  # -> flatten(Result)

# ----
# Arrangement and Finishing Touches
# Arrange Printable Geometry
# Sidebar Cap
# Top Clip Fasteners
unit_x_5 = UnitX(Factor=expression_21)
move_30 = Move(Geometry=move_29.Geometry, Motion=unit_x_5)  # -> Geometry, Transform
deconstruct_domain_9 = DeconstructDomain(Domain=deconstruct_box_6.Y)  # -> Start, End
clip_offset_y = Slider(19, range=0..50)
# Sidebar Clip
expression_23 = Expression(sectionsMinY=deconstruct_domain_9.Start, clipOffsetY=clip_offset_y, Expression="sectionsMinY - clipOffsetY")
brep_16 = Brep(<brep referenced from the Rhino model>)
# Alignment Point
point_5 = Point(Point(-3.194893356, -767.0594347, 27.33862199))
brep_17 = Brep(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)
brep_18 = Brep([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])
point_6 = Point(Point(1578.710793, -976.0964946, 3.015133469))
unit_y_5 = UnitY(Factor=Slider(-57, range=-100..0))

# ----
# Add Top Section Label 2
split_list_6 = SplitList(List=move_30.Geometry, Index=1)  # -> ListA, ListB
box_10 = Box(split_list_6.ListA)
deconstruct_box_8 = DeconstructBox(Box=box_10)  # -> Plane, X, Y, Z
deconstruct_domain_10 = DeconstructDomain(Domain=deconstruct_box_8.Y)  # -> Start, End
z_offset_2 = Slider(10.466, range=0..50)
y_offset_2 = Slider(-5.116, range=-30..0)
deconstruct_domain_11 = DeconstructDomain(Domain=deconstruct_box_8.X)  # -> Start, End
expression_24 = Expression(offset=y_offset_2, y=deconstruct_domain_10.End, Expression="y+offset")
construct_point_22 = ConstructPoint(XCoordinate=deconstruct_domain_11.Start, YCoordinate=expression_24, ZCoordinate=z_offset_2)
construct_point_23 = ConstructPoint(XCoordinate=deconstruct_domain_11.End, YCoordinate=expression_24, ZCoordinate=z_offset_2)
line_14 = Line(StartPoint=construct_point_22, EndPoint=construct_point_23)
text_depth_2 = Slider(2.129, range=0..4)
text_size_6 = Slider(3.22, range=1..5)
unit_y_6 = UnitY(Factor="-1")
extrude_2 = Extrude(Base=line_14, Direction=unit_y_6)
text_on_surface_3 = TextOnSurface(
    Text="DOG MACHINE 1.0",
    Font="Arial Bold:yes Italic:no",
    Height=text_size_6,
    Depth=text_depth_2,
    BaseLine=line_14,
    BaseSurface=extrude_2)
merge_15 = Merge(Data1=split_list_6.ListA, Data2=text_on_surface_3)
solid_union_5 = SolidUnion(Breps=flatten(merge_15))
merge_16 = Merge(Data1=solid_union_5, Data2=split_list_6.ListB)  # -> flatten(Result)

merge_17 = Merge(Data1=merge_14, Data2=merge_16)
volume_11 = Volume(Geometry=merge_17)  # -> Volume, Centroid
deconstruct_13 = Deconstruct(Point=volume_11.Centroid)  # -> XComponent, YComponent, ZComponent
construct_point_24 = ConstructPoint(XCoordinate=deconstruct_13.XComponent, YCoordinate=expression_23, ZCoordinate=0)
vector_2pt_16 = Vector2Pt(PointA=point_5, PointB=construct_point_24, Unitize=False)  # -> Vector, Length
move_31 = Move(Geometry=brep_16, Motion=vector_2pt_16.Vector)  # -> Geometry, Transform

split_list_7 = SplitList(List=construct_point_24, Index=2)  # -> ListA, ListB

vector_2pt_17 = Vector2Pt(PointA=point_6, PointB=split_list_7.ListA, Unitize=False)  # -> Vector, Length
addition_3 = Addition(A=vector_2pt_17.Vector, B=unit_y_5)
move_32 = Move(Geometry=graft(brep_18), Motion=addition_3)  # -> Geometry, Transform

list_length_8 = ListLength(List=vector_2pt_16.Vector)
expression_25 = Expression(l=list_length_8, Expression="l/2")
list_item_38 = ListItem(List=vector_2pt_16.Vector, Index=first_clip, Wrap=True)
list_item_39 = ListItem(List=vector_2pt_16.Vector, Index=expression_25, Wrap=True)
move_33 = Move(Geometry=brep_17, Motion=list_item_38)  # -> Geometry, Transform
move_34 = Move(Geometry=brep_17, Motion=list_item_39)  # -> Geometry, Transform
replace_items = ReplaceItems(
    List=move_31.Geometry,
    Item=[move_33.Geometry, move_34.Geometry],
    Indices=flatten([first_clip, expression_25]),
    Wrap=False)
stream_filter_2 = StreamFilter(Gate=top_clip_type, Stream0=move_31.Geometry, Stream1=replace_items)

# ----
# Bakeable Geometry
# (@ Control Menu)
merge_18 = Merge(Data1=merge_17, Data2=stream_filter_2, Data3=flatten(move_32.Geometry))  # -> flatten(Result)

brep_19 = Brep(merge_18)

# ----
# Draw Box Around Output Geometry
group_2 = Group(Geometry=merge_18)
box_11 = Box(group_2)
border_offset = Slider(50, range=0..50)
deconstruct_box_9 = DeconstructBox(Box=box_11)  # -> Plane, X, Y, Z
deconstruct_domain_12 = DeconstructDomain(Domain=deconstruct_box_9.X)  # -> Start, End
deconstruct_domain_13 = DeconstructDomain(Domain=deconstruct_box_9.Y)  # -> Start, End
expression_26 = Expression(start=deconstruct_domain_13.Start, offset=border_offset, Expression="start-offset")
expression_27 = Expression(end=deconstruct_domain_13.End, offset=border_offset, Expression="end+offset")
expression_28 = Expression(start=deconstruct_domain_12.Start, offset=border_offset, Expression="start-offset")
expression_29 = Expression(end=deconstruct_domain_12.End, offset=border_offset, Expression="end+offset")
construct_domain = ConstructDomain(DomainStart=expression_28, DomainEnd=expression_29)
construct_domain_2 = ConstructDomain(DomainStart=expression_26, DomainEnd=expression_27)
rectangle = Rectangle(Plane=PlaneXY(0, 0, 0), XSize=construct_domain, YSize=construct_domain_2, Radius=0)  # -> Rectangle, Length
