# Grasshopper definition parametricShape.gh (Grasshopper 1.0.8)
# plug-ins: Bifocals

# ----
# Slicing Machine
# Right click and choose “Set One Brep”,
# then click your 3D object to slice in Rhino.
material_thickness = Slider(5.92, range=0..6)
activate_slicer = BooleanToggle(True)
brep = Brep(<brep referenced from the Rhino model>)

# ----
# Volume Options
height = Slider(100, range=0..100)
top_rotation = Slider(0.475, range=0..3.142)
twist = Slider(4.934, range=0..6.283)

# ----
# **If True, loft will generate. Turn off to live-adjust
# curves without waiting for loft processing.
enable_loft = BooleanToggle(False)

# ----
# Bottom Face
num_zags = Slider(46, range=0..100)
zag_stretch = Slider(13.929, range=0..20)
num_sides = Slider(5, range=3..40)
shape_edge_roundness = Slider(0, range=0..100)
zigzag_smoothing = Slider(0, range=0..10)
size_xy = Slider(50.548, range=0..100)

# ----
# *If True, top face will be the same shape as bottom,
# and “Top Face” controls have no effect.
facial_symmetry = BooleanToggle(False)

# ----
# Top Face
zag_stretch_2 = Slider(20, range=0..20)
num_zags_2 = Slider(8, range=0..100)
zigzag_smoothing_2 = Slider(10, range=0..10)
shape_edge_roundness_2 = Slider(0, range=0..100)
size_xy_2 = Slider(18.616, range=0..100)
num_sides_2 = Slider(7, range=3..40)

# ----
# Place Volume at Origin
stream_gate = StreamGate(Stream=brep, Gate=activate_slicer)  # -> Target0, Target1
construct_point = ConstructPoint(XCoordinate=0, YCoordinate=0, ZCoordinate=0)
bounding_box = BoundingBox(Content=stream_gate.Target1, Plane=PlaneXY(0, 0, 0))  # -> Box, Box_2
volume = Volume(Geometry=bounding_box.Box)  # -> Volume, Centroid
deconstruct_box = DeconstructBox(Box=bounding_box.Box)  # -> Plane, X, Y, Z
deconstruct_domain = DeconstructDomain(Domain=deconstruct_box.Z)  # -> Start, End
deconstruct = Deconstruct(Point=volume.Centroid)  # -> XComponent, YComponent, ZComponent
construct_point_2 = ConstructPoint(XCoordinate=deconstruct.XComponent, YCoordinate=deconstruct.YComponent, ZCoordinate=deconstruct_domain.Start)
vector_2pt = Vector2Pt(PointA=construct_point_2, PointB=construct_point, Unitize=False)  # -> Vector, Length
move = Move(Geometry=brep, Motion=vector_2pt.Vector)  # -> Geometry, Transform

# ----
# Get contour start point…
volume_2 = Volume(Geometry=move.Geometry)  # -> Volume, Centroid
deconstruct_2 = Deconstruct(Point=volume_2.Centroid)  # -> XComponent, YComponent, ZComponent
construct_point_3 = ConstructPoint(XCoordinate=deconstruct_2.XComponent, YCoordinate=deconstruct_2.YComponent, ZCoordinate=deconstruct_domain.Start)
point = Point(construct_point_3)

# ----
# Zig Zag Machine
curve = Curve(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)
line = Line(StartPoint=Point(0, 0, 0), EndPoint=Point(0, 2, 0))
stretch = Stretch(Geometry=curve, Axis=line, Length=20, Rigid=False)
stretch_2 = Stretch(Geometry=stretch, Axis=Line((0, 0, 0), (2, 0, 0)), Length=zag_stretch, Rigid=False)
bounding_box_2 = BoundingBox(Content=stretch_2, Plane=PlaneXY(0, 0, 0))  # -> Box, Box_2
deconstruct_box_2 = DeconstructBox(Box=bounding_box_2.Box)  # -> Plane, X, Y, Z
deconstruct_domain_2 = DeconstructDomain(Domain=deconstruct_box_2.Y)  # -> Start, End
vector_xyz = VectorXYZ(XComponent=0, YComponent=deconstruct_domain_2.End, ZComponent=0)  # -> Vector, Length
linear_array = LinearArray(Geometry=stretch_2, Direction=vector_xyz.Vector, Count=num_zags)  # -> Geometry, Transform
join_curves = JoinCurves(Curves=linear_array.Geometry, Preserve=False)

# ----
# Zig Zag Machine
curve_2 = Curve(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)
line_2 = Line(StartPoint=Point(0, 0, 0), EndPoint=Point(0, 2, 0))
stretch_3 = Stretch(Geometry=curve_2, Axis=line_2, Length=20, Rigid=False)
stretch_4 = Stretch(Geometry=stretch_3, Axis=Line((0, 0, 0), (2, 0, 0)), Length=zag_stretch_2, Rigid=False)
bounding_box_3 = BoundingBox(Content=stretch_4, Plane=PlaneXY(0, 0, 0))  # -> Box, Box_2
deconstruct_box_3 = DeconstructBox(Box=bounding_box_3.Box)  # -> Plane, X, Y, Z
deconstruct_domain_3 = DeconstructDomain(Domain=deconstruct_box_3.Y)  # -> Start, End
vector_xyz_2 = VectorXYZ(XComponent=0, YComponent=deconstruct_domain_3.End, ZComponent=0)  # -> Vector, Length
linear_array_2 = LinearArray(Geometry=stretch_4, Direction=vector_xyz_2.Vector, Count=num_zags_2)  # -> Geometry, Transform
join_curves_2 = JoinCurves(Curves=linear_array_2.Geometry, Preserve=False)

# ----
# Get contours and relevant data
contour = Contour(Shape=move.Geometry, Point=point, Direction=Vector(0, 0, 1), Distance=material_thickness)
move_to_plane = MoveToPlane(Geometry=contour, Plane=PlaneXY(0, 0, 0), Above=True, Below=True)  # -> Geometry, Transform
bounding_box_4 = BoundingBox(Content=move_to_plane.Geometry, Plane=PlaneXY(0, 0, 0))  # -> Box, Box_2
deconstruct_box_4 = DeconstructBox(Box=bounding_box_4.Box)  # -> Plane, X, Y, Z

# ----
# Face Shape Machine
deconstruct_box_5 = DeconstructBox(Box=join_curves)  # -> Plane, X, Y, Z
construct_point_4 = ConstructPoint(XCoordinate=0, YCoordinate=deconstruct_box_5.Y, ZCoordinate=0)
construct_point_5 = ConstructPoint(XCoordinate=0, YCoordinate=0, ZCoordinate=0)
expression = Expression(x=size_xy, y=shape_edge_roundness, z=num_sides, Expression="x * y / 100")
line_3 = Line(StartPoint=construct_point_5, EndPoint=construct_point_4)
polygon = Polygon(Plane=PlaneXY(0, 0, 0), Radius=size_xy, Segments=num_sides, FilletRadius=expression)  # -> Polygon, Length
flow = Flow(
    Geometry=join_curves,
    Base=line_3,
    Target=polygon.Polygon,
    ReverseBase=False,
    ReverseTarget=False,
    Stretch=True,
    Rigid=False)
fillet = Fillet(Curve=flow, Radius=zigzag_smoothing)

# ----
# Face Shape Machine
deconstruct_box_6 = DeconstructBox(Box=join_curves_2)  # -> Plane, X, Y, Z
construct_point_6 = ConstructPoint(XCoordinate=0, YCoordinate=deconstruct_box_6.Y, ZCoordinate=0)
construct_point_7 = ConstructPoint(XCoordinate=0, YCoordinate=0, ZCoordinate=0)
expression_2 = Expression(x=size_xy_2, y=shape_edge_roundness_2, z=num_sides_2, Expression="x * y / 100")
line_4 = Line(StartPoint=construct_point_7, EndPoint=construct_point_6)
polygon_2 = Polygon(Plane=PlaneXY(0, 0, 0), Radius=size_xy_2, Segments=num_sides_2, FilletRadius=expression_2)  # -> Polygon, Length
flow_2 = Flow(
    Geometry=join_curves_2,
    Base=line_4,
    Target=polygon_2.Polygon,
    ReverseBase=False,
    ReverseTarget=False,
    Stretch=True,
    Rigid=False)
fillet_2 = Fillet(Curve=flow_2, Radius=zigzag_smoothing_2)

# ----
# Lofting Machine
unit_z = UnitZ(Factor=height)
merge = Merge(Data1=fillet, Data2=fillet_2)
cull_index = CullIndex(List=merge, Indices=facial_symmetry, Wrap=True)
move_2 = Move(Geometry=cull_index, Motion=unit_z)  # -> Geometry, Transform
area = Area(Geometry=flow)  # -> Area, Centroid
area_2 = Area(Geometry=move_2.Geometry)  # -> Area, Centroid
rotate = Rotate(Geometry=move_2.Geometry, Angle=top_rotation, Plane=area_2.Centroid)  # -> Geometry, Transform
line_5 = Line(StartPoint=area.Centroid, EndPoint=area_2.Centroid)
merge_2 = Merge(Data1=fillet, Data2=rotate.Geometry)
stream_gate_2 = StreamGate(Stream=merge_2, Gate=enable_loft)  # -> Target0, Target1
loft = Loft(
    Curves=flatten(stream_gate_2.Target1),
    Options={Adjust=False, Closed=False, LoftEnds=0, LoftSimp=0, LoftType=0, Rebuild=10, Refit=0.01})
cap_holes = CapHoles(Brep=loft)
twist_2 = Twist(Geometry=cap_holes, Axis=line_5, Angle=twist, Infinite=False, Rigid=False)

# ----
# <— Bake your Brep here!
brep_2 = Brep(twist_2)

# ----
# Get highest width* and number of curves
# *I have just realized that this operation was unneccesary:
# I could have gotten the maximum width by pulling the x domain
# from the original volume’s bounding box.
# I will leave it for posterity’s sake.
reverse_sorted_list_index_for_largest_wi = Panel("0")  # "Reverse Sorted List Index (for largest width)"
list_length = ListLength(List=flatten(deconstruct_box_4.X))
number = Number(flatten(deconstruct_box_4.X))
sort_list = SortList(Keys=number)  # -> reverse(Keys), ValuesA
list_item = ListItem(List=sort_list.Keys, Index=reverse_sorted_list_index_for_largest_wi, Wrap=True)
max_width = Panel(list_item)

# ----
# Move visible volume off of outline
unit_x = UnitX(Factor=max_width)
move_3 = Move(Geometry=move.Geometry, Motion=expr("-x", unit_x))  # -> Geometry, Transform

# ----
# Move curves along X-axis by max width
series = Series(Start=0, Step=max_width, Count=list_length)
vector_xyz_3 = VectorXYZ(XComponent=series, YComponent=0, ZComponent=0)  # -> Vector, Length
move_4 = Move(Geometry=flatten(move_to_plane.Geometry), Motion=vector_xyz_3.Vector)  # -> Geometry, Transform

# ----
# Gets curve “index”
series_2 = Series(Start=0, Step=1, Count=list_length)

# ----
# Generate Test Base Lines from Curve Area Centroids
area_3 = Area(Geometry=move_4.Geometry)  # -> Area, Centroid
expression_3 = Expression(x=number, Expression="-x/2")
expression_4 = Expression(x=number, Expression="x/2")
point_2 = Point(area_3.Centroid)
deconstruct_3 = Deconstruct(Point=point_2)  # -> XComponent, YComponent, ZComponent
addition = Addition(A=deconstruct_3.XComponent, B=expression_3)
addition_2 = Addition(A=deconstruct_3.XComponent, B=expression_4)
construct_point_8 = ConstructPoint(XCoordinate=addition, YCoordinate=deconstruct_3.YComponent, ZCoordinate=0)
construct_point_9 = ConstructPoint(XCoordinate=addition_2, YCoordinate=deconstruct_3.YComponent, ZCoordinate=0)
line_6 = Line(StartPoint=construct_point_8, EndPoint=construct_point_9)

# ----
# Draw and orient text
text_on_surface = TextOnSurface(Text=series_2, Font="Sans Bold:no Italic:no", Height=5, Depth=0, BaseLine=line_6, BaseSurface=move_4.Geometry)
rotate_axis = RotateAxis(Geometry=text_on_surface, Angle=1.570796327, Axis=Line((0, 0, 0), (10, 0, 0)))  # -> Geometry, Transform
brep_wireframe = BrepWireframe(Brep=rotate_axis.Geometry, Density=-1)
curve_3 = Curve(brep_wireframe)

# ----
# Combine cutting curves and text into curve
# collection that’s sent back to controls at start… Phew!
curve_4 = Curve([move_4.Geometry, curve_3])

# ----
# Bake this curve^ and you’re in business!
curve_5 = Curve(curve_4)
