# Grasshopper definition L3-3DPSlicerGcodeGeneratorBase.gh (Grasshopper 1.0.8)
# plug-ins: RhinoCodePluginGH, BullAnt, Bifocals

build_plate_midpoint = Slider(105, range=0..200)
# [TODO]: Create Test Cylinder and Move to center of Bed
radius = Slider(10, range=0..100)
height = Slider(1.5, range=0..3)
unit_z = UnitZ(Factor=height)
circle = Circle(Plane=PlaneXY(0, 0, 0), Radius=radius)
build_plate_middle = VectorXYZ(XComponent=build_plate_midpoint, YComponent=build_plate_midpoint, ZComponent=0)  # -> Vector, Length
extrude = Extrude(Base=circle, Direction=unit_z)
cap_holes = CapHoles(Brep=extrude)
move = Move(Geometry=cap_holes, Motion=build_plate_middle.Vector)  # -> Geometry, Transform
volume = Volume(Geometry=move.Geometry)  # -> Volume, Centroid
layer_height = Slider(0.3, range=0.001..0.5)
deconstruct = Deconstruct(Point=volume.Centroid)  # -> XComponent, YComponent, ZComponent
construct_point = ConstructPoint(XCoordinate=deconstruct.XComponent, YCoordinate=deconstruct.YComponent, ZCoordinate=layer_height)
# [TODO]: Create Contours / Perimeters)
contour = Contour(Shape=move.Geometry, Point=construct_point, Direction=Vector(0, 0, 1), Distance=layer_height)
cull_index = CullIndex(List=flatten(contour), Indices=0, Wrap=True)  # -> graft(List)
panel = Panel(cull_index)
boundary_surfaces = BoundarySurfaces(Edges=cull_index)
extrusion_width = Slider(0.48, range=0..1)
deconstruct_box = DeconstructBox(Box=boundary_surfaces)  # -> Plane, X, Y, Z
number = Number(deconstruct_box.X)
# Extrusion width:
# .4 * 1.2 == .48
deconstruct_domain = DeconstructDomain(Domain=deconstruct_box.X)  # -> Start, End
deconstruct_domain_2 = DeconstructDomain(Domain=deconstruct_box.Y)  # -> Start, End
deconstruct_domain_3 = DeconstructDomain(Domain=deconstruct_box.Z)  # -> Start, End
division = Division(A=number, B=extrusion_width)
curve = Curve([<curve referenced from the Rhino model> x4])
series = Series(Start=deconstruct_domain.Start, Step=extrusion_width, Count=division)
simplify_curve = SimplifyCurve(Curve=curve)  # -> Curve, Simplified
ggsimplifypolyline = GgSimplifyPolyline(Polyline=curve, Tol=0.001)
# [TODO]: Create Infill Patterns
construct_point_2 = ConstructPoint(XCoordinate=series, YCoordinate=deconstruct_domain_2.Start, ZCoordinate=deconstruct_domain_3.Start)
construct_point_3 = ConstructPoint(XCoordinate=series, YCoordinate=deconstruct_domain_2.End, ZCoordinate=deconstruct_domain_3.End)
line = Line(StartPoint=construct_point_2, EndPoint=construct_point_3)
brep_line = BrepLine(Brep=boundary_surfaces, Line=line, LimitToFirst=False)  # -> Curves, Points
panel_3 = Panel(brep_line.Curves)
curve_2 = Curve(<curve referenced from the Rhino model>)  # disabled
trim_tree = TrimTree(Tree=brep_line.Curves, Depth=2)
merge = Merge(Data1=cull_index, Data2=trim_tree)
simplify_curve_2 = SimplifyCurve(Curve=curve_2)  # -> Curve, Simplified; disabled
ggsimplifypolyline_2 = GgSimplifyPolyline(Polyline=curve_2, Tol=0.001)  # disabled
printer_resolution = Slider(0.1, range=0..0.4)
# [TODO]: Combine Perimeters and Infill
panel_4 = Panel(merge)
panel_5 = Panel(trim_tree)
md_slider = MDSlider(
    SliderMode=0,
    slider_value=Point(0.7134146341, 0.3536585366, 0.5),
    x_domain=Domain(-100, 100),
    y_domain=Domain(-100, 100),
    z_domain=Domain(0, 1))  # disabled
divide_length = DivideLength(Curve=merge, Length=printer_resolution)  # -> Points, Tangents, Parameters
md_slider_2 = MDSlider(
    SliderMode=0,
    slider_value=Point(0.5, 0.3536585366, 0.5),
    x_domain=Domain(-100, 100),
    y_domain=Domain(-100, 100),
    z_domain=Domain(0, 1))  # disabled
polyline = PolyLine(Vertices=divide_length.Points, Closed=False)
# [TODO]: Create Line Segments from Perimeters and Infill
panel_6 = Panel(polyline)
panel_7 = Panel("Simplify Curve")  # disabled
move_2 = Move(Geometry=simplify_curve_2.Curve, Motion=md_slider)  # -> Geometry, Transform; disabled
panel_8 = Panel("ggSimplifyPolyline")  # disabled
move_3 = Move(Geometry=ggsimplifypolyline_2, Motion=md_slider_2)  # -> Geometry, Transform; disabled
trim_tree_2 = TrimTree(Tree=polyline, Depth=1)
box = Box(move_3.Geometry)  # disabled
box_2 = Box(move_2.Geometry)  # disabled
area = Area(Geometry=box)  # -> Area, Centroid; disabled
text_tag = TextTag(Location=area.Centroid, Text=panel_8)  # disabled
area_2 = Area(Geometry=box_2)  # -> Area, Centroid; disabled
text_tag_2 = TextTag(Location=area_2.Centroid, Text=panel_7)  # disabled
simplify_curve_3 = SimplifyCurve(Curve=trim_tree_2)  # -> Curve, Simplified
ggsimplifypolyline_3 = GgSimplifyPolyline(Polyline=trim_tree_2, Tol=0.001)
panel_9 = Panel(trim_tree_2)
explode = Explode(Curve=ggsimplifypolyline_3, Recursive=True)  # -> Segments, Vertices
explode_2 = Explode(Curve=simplify_curve_3.Curve, Recursive=True)  # -> Segments, Vertices
panel_10 = Panel(polyline)
trim_tree_3 = TrimTree(Tree=explode_2.Segments, Depth=1)
# [TODO]: Use lines for testing gcode generation then replace with line segments from slicing
panel_11 = Panel(trim_tree_3)
list_item = ListItem(List=flatten(trim_tree_3), Index=0, Wrap=True)

# ---- group: Example of a line for testing
construct_point_4 = ConstructPoint(XCoordinate=Slider(5, range=-10..30), YCoordinate=Slider(1, range=-10..30), ZCoordinate=Slider(0, range=-10..30))
construct_point_5 = ConstructPoint(XCoordinate=Slider(30, range=-10..30), YCoordinate=Slider(1, range=-10..30), ZCoordinate=Slider(0, range=-10..30))
line_2 = Line(StartPoint=construct_point_4, EndPoint=construct_point_5)

# ---- group: A second line for testing
construct_point_6 = ConstructPoint(XCoordinate=Slider(10, range=-10..30), YCoordinate=Slider(10, range=-10..30), ZCoordinate=Slider(1, range=-10..30))
construct_point_7 = ConstructPoint(XCoordinate=Slider(10, range=-10..30), YCoordinate=Slider(20, range=-10..30), ZCoordinate=Slider(1, range=-10..30))
line_3 = Line(StartPoint=construct_point_6, EndPoint=construct_point_7)

# ----
line_4 = Line(list_item)
panel_12 = Panel(line_4)
divide_length_2 = DivideLength(Curve=line_4, Length=line_4)  # -> Points, Tangents, Parameters
nozzle_diameter = Panel("0.4")
filament_diameter = Panel("1.75")
layer_height_2 = Panel("0.3")
extrusion_width_factor = Panel("1.2")
travel_feed_rate = Panel("1200")
layer_change_feed_rate = Panel("720")
extrusion_feed_rate = Panel("600")
# [TODO]: Initialize Input Parameters
line_5 = Line(trim_tree_3)
# NOTE THAT THIS GCODE OUTPUT ASSUMES:
# - A PRUSA MK3S+ as the Printer
# - PLA Material
# - Extrusion Temperature: 215C
# - Heated Bed Temperature: 60C
multiplication = Multiplication(A=nozzle_diameter, B=extrusion_width_factor)
image_sampler = ImageSampler(
    FilePath="/var/folders/jd/zr99dtf57qj_0fk9w9zbfrb00000gn/T/TemporaryItems/NSIRD_screencaptureui_V6h4Je/Screenshot 2024-11-04 at 9.43.08 PM.png",
    Filter="Colour",
    Interpolate=True,
    Umax=1054,
    Umin=1,
    Vmax=812,
    Vmin=1,
    Wrap=1)
# [TODO]: Implement the gcode generation algorithm in Python
python_3_script_generate_gcode = Python3Script(
    lines=flatten(line_5),
    nozzle_diameter=nozzle_diameter,
    filament_diameter=filament_diameter,
    layer_height=layer_height_2,
    extrusion_width=multiplication,
    travel_feed_rate=travel_feed_rate,
    layer_change_feed_rate=layer_change_feed_rate,
    extrusion_feed_rate=extrusion_feed_rate)  # -> out, gcode_output; inputs lines: list of Line, nozzle_diameter: Double, filament_diameter: Double, layer_height: Double, extrusion_width: Double, travel_feed_rate: Double, layer_change_feed_rate: Double, extrusion_feed_rate: Double
# ---------- python_3_script_generate_gcode: Python ----------
"""
    This file contains parameters, helpers, and setup to 
    create a basic gcode generation algorithm from line segments.
    
    The main 
    
    Inputs:
        lines: the line segments to be converted into gcode commands for extrusion 
        nozzle_diameter: the diameter of the 3D printer's nozzle
        filament_diameter: the diameter of the 3d printing filament
        layer_height: the height of each layer in the print
        extrusion_width: the width of the extruded line from the printer
        travel_feed_rate: the speed at which the extruder moves in X and Y
        layer_change_feed_rate: the speed at which teh extruder moves when 
            changing layers in the Z direction
        extrusion_feed_rate: the speed at which the extruder move when extruding

    Output:
        gcode_output: a string with gcode commands separate by new-lines"""

__author__ = "mrivera-cu"

import rhinoscriptsyntax as rs

import math


########## CONSTANTS BELOW ###############

# GCODE COMMANDS
COMMAND_MOVE = "G1"

# GCODE PARAM NAMES
PARAM_X = "X"
PARAM_Y = "Y"
PARAM_Z = "Z"
PARAM_E = "E"
PARAM_F = "F"

# Separates commands
COMMAND_DELIMITER = "\n"

# Precision for converting floats to strings
E_VALUE_PRECISION = 5
XYZ_VALUE_PRECISION = 3

# Float equality precision
FLOAT_EQUALITY_PRECISION = 5

#### WARNING: DO NOT EDIT THE START GCODE! #####
start_gcode_lines = [";START GCODE",
    "M201 X1000 Y1000 Z200 E5000 ; sets maximum accelerations, mm/sec^2",
    "M203 X200 Y200 Z12 E120 ; sets maximum feedrates, mm / sec",
    "M204 S1250 T1250 ; sets acceleration (S) and retract acceleration (R), mm/sec^2",
    "M205 X8.00 Y8.00 Z0.40 E4.50 ; sets the jerk limits, mm/sec",
    "M205 S0 T0 ; sets the minimum extruding and travel feed rate, mm/sec",
    ";TYPE:Custom",
    "M862.3 P \"MK3S\" ; printer model check",
    "M862.1 P0.4 ; nozzle diameter check",
    "M115 U3.13.3 ; tell printer latest fw version",
    "G90 ; use absolute coordinates",
    "M83 ; extruder relative mode",
    "M104 S215 ; set extruder temp",
    "M140 S60 ; set bed temp",
    "M190 S60 ; wait for bed temp",
    "M109 S215 ; wait for extruder temp",
    "G28 W ; home all without mesh bed level",
    "G80 X86.6877 Y64.7708 W85.2412 H59.1573 ; mesh bed levelling",
    "G1 Z0.2 F720",
    "G1 Y-3 F1000 ; go outside print area",
    "G92 E0",
    "G1 X60 E9 F1000 ; intro line",
    "G1 X100 E12.5 F1000 ; intro line",
    "G92 E0",
    "M221 S95",
    "; Don't change E values below. Excessive value can damage the printer.",
    "M907 E538 ; set extruder motor current",
    "G21 ; set units to millimeters",
    "G90 ; use absolute coordinates",
    "M83 ; use relative distances for extrusion",
    "M900 K0.05 ; Filament gcode LA 1.5",
    "M900 K30 ; Filament gcode LA 1.0",
    "M107"]
    
##### WARNING: DO NOT EDIT THE END GCODE! ######
end_gcode_lines = ["; END Gcode", 
    "M204 S1000", 
    "M107", 
    ";TYPE:Custom", 
    "; Filament-specific end gcode", 
    "G1 Z180 F720 ; Move print head further up", 
    "G1 X0 Y200 F3600 ; park", 
    "G4 ; wait",
    "M221 S100 ; reset flow",
    "M900 K0 ; reset LA",
    "M104 S0 ; turn off temperature",
    "M140 S0 ; turn off heatbed",
    "M107 ; turn off fan",
    "M84 ; disable motors",
    "M73 P100 R0 ; print progress done",
    "M73 Q100 S0 ; print progress done"]

#########################################################################

# Converts a float (f) to a string with some precision of decimal places
# For example: 
# Input: f=0.1234, precision=3 
# Output: "0.123"
def float_to_string(f, precision=XYZ_VALUE_PRECISION): 
    f = float(f)
    str_format = "{value:." + str(precision) +"f}"
    return str_format.format(value=f)
    
# Helper to convert the E value to the proper precision
def e_value_to_string(e):
    return float_to_string(e, E_VALUE_PRECISION)

# Helper to convert the XYZ value to the proper precision
def xyz_value_to_string(e):
    return float_to_string(e, XYZ_VALUE_PRECISION)

#########################################################################

# Helper function to compare floats in grasshopper/python due to float precision errors
def are_floats_equal(f1, f2, epsilon=10**(-FLOAT_EQUALITY_PRECISION)):
    f1 *= 10**FLOAT_EQUALITY_PRECISION
    f2 *= 10**FLOAT_EQUALITY_PRECISION
    return math.fabs(f2 - f1) <= epsilon
    
# Helper function to compare if two points are equal (have the same coordinates)
# by handling float precision comparisons
def is_same_pt(ptA, ptB):
    return are_floats_equal(ptA[0], ptB[0]) and are_floats_equal(ptA[1], ptB[1]) and are_floats_equal(ptA[2], ptB[2])
     
     
########################################################################
# creates a string consisting of a G1 move command and 
# any associated parameters
def gcode_move(current_pos, next_pos, feed_rate=None, should_extrude=False):
    # Start with "G1" as command
    move_command_str = COMMAND_MOVE
    
    # Compare X positions
    if (not are_floats_equal(current_pos[0],next_pos[0])):
        # we have a different x position so add it as a parameter to the command
        x_value = float_to_string(next_pos[0], precision=XYZ_VALUE_PRECISION)
        # Add X<x_value> to move string, e.g., X100.00
        move_command_str += " " + PARAM_X + x_value
    
    # Compare Y positions
    if (not are_floats_equal(current_pos[1], next_pos[1])):
        # we have a different y position so add the new position as a parameter
        y_value = float_to_string(next_pos[1], precision=XYZ_VALUE_PRECISION)
        # Add Y<y_value> to move string, e.g., Y100.00
        move_command_str += " " + PARAM_Y + y_value
    
    # Compare Z position
    if (not are_floats_equal(current_pos[2], next_pos[2])):
        # we have a different z position so add the new position as a parameter
        z_value = float_to_string(next_pos[2], precision=XYZ_VALUE_PRECISION)
        # Add Z<z_value> to move string, e.g., Z100.00
        move_command_str += " " + PARAM_Z + z_value
        print("Z move command: ", move_command_str)
    
    if (should_extrude):
        #requires calculation of E value...
        threeD_distance = math.dist(current_pos, next_pos)
        # Calculate extrusion "slice" area...
        a_out = (layer_height * (extrusion_width - layer_height)) + (math.pi * (layer_height/2)**2)

        v_out = a_out * threeD_distance
        a_in = math.pi * (filament_diameter / 2)**2 # v_in for 1mm. 
        e_factor = v_out/a_in
        e_value = float_to_string(e_factor, precision=E_VALUE_PRECISION)
        move_command_str += " " + PARAM_E + e_value



    # [TODO]: handle "should_extrude" == true by determining the proper amount to
    # extrude using the capsule model, then append the E parameter and value
    # to the move command.
    # NOTE: YOUR FLOAT PRECISION MUST MATCH E_VALUE_PRECISION
    
    
    
    # See if we have a feedrate to use, and handle it differently than other 
    # parameters as it is an integer value
    if (feed_rate is not None):
        # feed rate is an int
        feed_rate_value = round(feed_rate)
        # Add F<feed_rate_value> to move string, e.g., F2000
        move_command_str += " " + PARAM_F + str(feed_rate_value)   
    
    # Remove excess whitespace on ends
    move_command_str = move_command_str.strip(" ")
    return move_command_str


############################################
############################################
############################################
    
''' Here's the main method of the script that uses the helper methods above '''

def generate_gcode():
    print("Working...")
    # [TODO]: Implement the algorithm to generate gcode for each layer by 
    # first to moveing to the layer height, then moving to each line segment.
    # Once at a line segment, you should move and extrude along it, 
    # then move (travel) to the next line until there are no lines left
    # For each of these movements, you should append the command to
    # the list: `all_move_commands`
    current_position = [0, 0, 0]        # start extruder at the origin
    all_move_commands = []              # list to hold for all the move commands

    for i in range(0, len(lines)):
        # Get pts of the line segment
        line = lines[i]
        line_start_position = line.From
        line_end_position = line.To
        # print("End: ", line_end_position)
        
        # [TODO]: Handle moving to the next layer (Z Position)
        # NOTE- ALL Z MOVEMENTS SHOULD:
        # 1) BE INDEPENDENT MOVES(e.g., G1 Z# and not move with other positions like XYE) 
        # 2) USE THE `layer_change_feedrate`
        # 3) BE IN INCREASING ORDER
        if (line_start_position[2] != current_position[2]):
            print("Z has changed...")
            new_z_pos = [current_position[0], current_position[1], line_start_position[2]]
            layer_change_command = gcode_move(current_position, new_z_pos, feed_rate=layer_change_feed_rate)
            # Append command
            print("currentPos: ", current_position, " newPos: ", line_start_position)
            all_move_commands.append(layer_change_command)
            current_position = new_z_pos #update position for next command
            print("New Z Pos: ", new_z_pos)

        # Now if our current_position is not the start of our line segment
        # we need to move (travel) to the line segment's starting point
        if not is_same_pt(current_position, line_start_position):
            # [Move to the the line_start_position
            move_to_line_start_command = gcode_move(current_position, line_start_position, feed_rate=travel_feed_rate)
            # Append command
            all_move_commands.append(move_to_line_start_command)
            current_position = line_start_position
        
        # [TODO]: Once our extruder is at the start of the line, create a 
        # command to move AND extrude along 
        # the line segment using `extrusion_feed_rate`
        if is_same_pt(current_position, line_start_position):
            extrude_line_command = gcode_move(current_position, line_end_position, extrusion_feed_rate, True)
            all_move_commands.append(extrude_line_command)
            current_position = line_end_position

        

        # [TODO]: Append the move command across the line segment 

        
        # # [TODO]: Update the current position of our extruder to be at the end of the line
        # current_position = [0, 0, 0]
        
    # End of for-loop above -- now create the full set of commands


    # Combine the `start_gcode`, `all_move_commands`, and `end_gcode`
    # into one list called `gcode_lines`   
    # gcode_lines = []
    gcode_lines = start_gcode_lines + all_move_commands + end_gcode_lines
    # gcode_lines = all_move_commands #temp for looking at gcode generation...

    # --- DO NOT EDIT BELOW ----
    # The takes the combined gcode_lines list and creates a string containing each line
    # separated by a COMMAND_DELIMITER (the new-line character), and sets it 
    # to the `gcode_output`variable of this component
    output = COMMAND_DELIMITER.join(gcode_lines)
    
    return output
    
''' RUN THE MAIN FUNCITON ABOVE - DO NOT EDIT '''
# this sets the gcode commands to be the the `gcode_output` variable of this grasshopper component
gcode_output = generate_gcode()
# ---------- end python_3_script_generate_gcode ----------
the_gcode_output = Panel(python_3_script_generate_gcode.gcode_output)
# [TODO]: Use Pancake Plug-in to Export Gcode Output File as .gcode
debugging_panel = Panel(python_3_script_generate_gcode.out)
