# Grasshopper definition L3slicer.gh (Grasshopper 1.0.8)
# plug-ins: RhinoCodePluginGH, PTComponentLibrary, Bifocals, Pancake

# ----
# Create Test Geometry (Cylinder)
radius = Slider(10, range=0..100)
height = Slider(3, range=0..3)
unit_z = UnitZ(Factor=height)
circle = Circle(Plane=PlaneXY(0, 0, 0), Radius=radius)
extrude = Extrude(Base=circle, Direction=unit_z)
cap_holes = CapHoles(Brep=extrude)

# ----
# Move to Printer Bed Center
build_plate_midpoint = Slider(105, range=0..200)
build_plate_middle = VectorXYZ(XComponent=build_plate_midpoint, YComponent=build_plate_midpoint, ZComponent=0)  # -> Vector, Length
move = Move(Geometry=cap_holes, Motion=build_plate_middle.Vector)  # -> Geometry, Transform

# ----
# Welcome to my insane slicer!
mesh = Mesh(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)

# ----
# Get Layer Perimeters
volume = Volume(Geometry=move.Geometry)  # -> Volume, Centroid
layer_height = Slider(0.3, range=0.001..0.5)
deconstruct = Deconstruct(Point=volume.Centroid)  # -> XComponent, YComponent, ZComponent
construct_point = ConstructPoint(XCoordinate=deconstruct.XComponent, YCoordinate=deconstruct.YComponent, ZCoordinate=layer_height)
contour = Contour(Shape=move.Geometry, Point=construct_point, Direction=Vector(0, 0, 1), Distance=layer_height)
cull_index = CullIndex(List=flatten(contour), Indices=0, Wrap=True)  # -> graft(List)

# ----
# Flip Top Contour*
# *Bizarrely, if the top contour Z value is the same as the top face of the contoured volume, the curve is drawn “upside down.”
# This causes the topmost perimeter to be drawn in the opposite direction of all others beneath it.
# Somewhat minor issue for regular printing, but top “layer” in vase mode.
plane_normal = PlaneNormal(Origin=Point(0, 0, 0), ZAxis=Vector(0, 0, -1))
cir = Circle(Plane=plane_normal, Radius=1)
flip = FlipCurve(Curve=cull_index, Guide=cir)  # -> Curve, Flag
panel = Panel(flip.Flag)

# ----
# Adjust desired extrusion width.
# .48 recommended.
extrusion_width = Slider(0.48, range=0..1)

# ----
# VASE MODE!
bottom_shell_layers = Slider(3, range=0..5)
spiral_vase_mode = BooleanToggle(False)

# ----
# Overlap Spacing Calculator
expression = Expression(extrusionWidth=extrusion_width, layerHeight=layer_height, Expression="extrusionWidth - layerHeight * (1 - PI/4)")

# ----
# Infill offset was added to help print some geometry other than a cylinder. But said geometry broke a couple of things down the line. I am keeping it here for future work.
# Adjust Linear Infill %
infill = Slider(27, range=10..100, expression="int(x/10) * 10")
expression_2 = Expression(a=expression, b=infill, Expression="a * (100 / b)")
infill_offset = BooleanToggle(False)

series = Series(Start=0, Step=1, Count=expr("Max(x, 0)", bottom_shell_layers))
cull_index_2 = CullIndex(List=flatten(flip.Curve), Indices=flatten(series), Wrap=True)  # -> graft(List)

# ----
# Selects bottom shell layers for infill*
# *only in vase mode. Otherwise all perimeters get infill.
# This step is relevant to vase mode only. It separates bottom shell layers from vase perimeters so that only the shell layers get infill processing.
# 
# Instead of splitting the perimeter list, this separates them such that the uppermost infill layer is repeated as the bottom perimeter in the vase spiral. This is a test.
list_length = ListLength(List=flatten(flip.Curve))
stream_gate = StreamGate(Stream=bottom_shell_layers, Gate=spiral_vase_mode)  # -> Target0, Target1
subtraction = Subtraction(A=list_length, B=stream_gate.Target1)
series_2 = Series(Start=stream_gate.Target1, Step=1, Count=subtraction)
cull_index_3 = CullIndex(List=flatten(flip.Curve), Indices=flatten(series_2), Wrap=True)  # -> graft(List)
stream_filter = StreamFilter(Gate=spiral_vase_mode, Stream0=flip.Curve, Stream1=cull_index_3)
stream_filter_2 = StreamFilter(Gate=spiral_vase_mode, Stream0=flip.Curve, Stream1=cull_index_2)

offset_curve = OffsetCurve(Curve=stream_filter, Distance=expr("-x * (2/3)", extrusion_width), Corners=1)
stream_filter_3 = StreamFilter(Gate=infill_offset, Stream0=stream_filter, Stream1=offset_curve)

# ----
# Build Infill Pattern
# (Rectilinear)
deconstruct_box = DeconstructBox(Box=stream_filter)  # -> Plane, X, Y, Z
number = Number(deconstruct_box.X)
deconstruct_domain = DeconstructDomain(Domain=deconstruct_box.X)  # -> Start, End
deconstruct_domain_2 = DeconstructDomain(Domain=deconstruct_box.Y)  # -> Start, End
deconstruct_domain_3 = DeconstructDomain(Domain=deconstruct_box.Z)  # -> Start, End
division = Division(A=number, B=expression_2)
expression_3 = Expression(a=number, b=expression_2, Expression="(a/2)%b")
addition = Addition(A=deconstruct_domain.Start, B=expression_3)
round = Round(Number=division)  # -> Nearest, Floor, Ceiling
series_3 = Series(Start=addition, Step=expression_2, Count=round.Ceiling)
construct_point_2 = ConstructPoint(XCoordinate=series_3, YCoordinate=deconstruct_domain_2.End, ZCoordinate=deconstruct_domain_3.End)
construct_point_3 = ConstructPoint(XCoordinate=series_3, YCoordinate=deconstruct_domain_2.Start, ZCoordinate=deconstruct_domain_3.Start)
line = Line(StartPoint=construct_point_3, EndPoint=construct_point_2)
brep_line = BrepLine(Brep=stream_filter_3, Line=line, LimitToFirst=False)  # -> Curves, Points
trim_tree = TrimTree(Tree=brep_line.Curves, Depth=2)

panel_2 = Panel(trim_tree)

# ----
# This orients the infill lines to reduce extruder travel time, and eliminates remaining travel by connecting infill lines with small line segments.
# Optimize w/Serpentine
python_3_script = Python3Script(lines=trim_tree)  # -> out, optimizedLines; inputs lines: list of Line
# ---------- python_3_script: Python ----------
"""Grasshopper Script"""

__author__ = "dingo"

# This script runs as many times as there are infill layers. 
# For each layer, it 

import rhinoscriptsyntax as rs

import math

optimizedLines = [lines[0]] #start list with current first line in layer

for i in range(0, len(lines)-1): #checks all lines and next neighbor, except last infill line.
    currentLine = lines[i]
    nextLine = lines[i+1]

    # check if which point of next line is closest to endpoint of current line
    if (math.dist(currentLine.To, nextLine.From) > math.dist(currentLine.To, nextLine.To)):
        nextLine.Flip() #flip next line if necessary
    
    connectorLine = rs.AddLine(currentLine.To, nextLine.From) #draw small connector between current and next line

    optimizedLines.append(connectorLine)
    optimizedLines.append(nextLine)
# ---------- end python_3_script ----------
panel_3 = Panel(python_3_script.optimizedLines)

line_2 = Line(python_3_script.optimizedLines)

# ----
# Process Vase Mode Contours Separately
# Format for Python Script
stream_filter_4 = StreamFilter(Gate=spiral_vase_mode, Stream1=stream_filter_2)
printer_resolution = Slider(0.1, range=0..0.4)
divide_length = DivideLength(Curve=stream_filter_4, Distance=printer_resolution, RoundUp=False, RoundDn=False)
polyline = PolyLine(Vertices=divide_length, Closed=False)
trim_tree_2 = TrimTree(Tree=polyline, Depth=1)
simplify_curve = SimplifyCurve(Curve=trim_tree_2)  # -> Curve, Simplified
explode = Explode(Curve=simplify_curve.Curve, Recursive=True)  # -> Segments, Vertices
trim_tree_3 = TrimTree(Tree=explode.Segments, Depth=1)
line_3 = Line(trim_tree_3)

# ----
# Combine Perimeters and Infill
merge = Merge(Data1=stream_filter, Data2=line_2)

list_item = ListItem(List=flatten(merge), Index=Slider(224, range=0..255), Wrap=True)
panel_4 = Panel(merge)

# ----
# Create Spiral Contours
# (Vase Mode)
python_3_script_2 = Python3Script(lines=line_3, layerHeight=layer_height)  # -> out, newLines; inputs lines: tree of Line
# ---------- python_3_script_2: Python ----------
"""Grasshopper Script"""

__author__ = "dingo"

# This script takes planar perimeters and gradually increases Z values to create a spiral.
# The resulting geometry allows for spiral vase mode printing with constant extrusion.

import rhinoscriptsyntax as rs
import math
import ghpythonlib.treehelpers as th # For manipulating data tree as a nested list.

data_tree = lines
perimeters = th.tree_to_list(data_tree) # Convert GH data tree to a nested list

newLines = [] # List for geometry export

# Iterate through layers.
for i in range(0, len(perimeters[0])-1):
    layerLength = 0
    lines = perimeters[0][i]
    # Get layer length by adding length of each line segment in layer.
    for s in range(len(lines)):
        layerLength += lines[s].Length
    # Initialize Z-increase variable.
    zIncrement = 0
    # Iterate through layer segements again, this time increasing
    # Z of each point according to ratio of segment length to perimeter length.
    for j in range(len(lines)):
        newPointFrom = rs.CreatePoint(lines[j].From.X, lines[j].From.Y, lines[j].From.Z + zIncrement)
        zIncrement += layerHeight/(layerLength/lines[j].Length)
        newPointTo = rs.CreatePoint(lines[j].To.X, lines[j].To.Y, lines[j].To.Z + zIncrement)
        lines[j].From = newPointFrom
        lines[j].To = newPointTo

# Export new geometry
newLines = th.list_to_tree(perimeters)
# ---------- end python_3_script_2 ----------
panel_5 = Panel(python_3_script_2.newLines)
line_4 = Line(python_3_script_2.newLines)

stream_filter_5 = StreamFilter(Gate=spiral_vase_mode, Stream1=line_4)
image_sampler = ImageSampler(Filter="Colour", Interpolate=True, Umax=1054, Umin=1, Vmax=812, Vmin=1, Wrap=1)

# ----
# Discretize Curves Into Line Segments
printer_resolution_2 = Slider(0.1, range=0..0.4)
divide_length_2 = DivideLength(Curve=merge, Distance=printer_resolution_2, RoundUp=False, RoundDn=False)

divide_length_3 = DivideLength(Curve=merge, Length=printer_resolution_2)  # -> Points, Tangents, Parameters

polyline_2 = PolyLine(Vertices=divide_length_3.Points, Closed=False)
trim_tree_4 = TrimTree(Tree=polyline_2, Depth=1)
simplify_curve_2 = SimplifyCurve(Curve=trim_tree_4)  # -> Curve, Simplified
explode_2 = Explode(Curve=simplify_curve_2.Curve, Recursive=True)  # -> Segments, Vertices

# ----
# Format for Python Script
trim_tree_5 = TrimTree(Tree=explode_2.Segments, Depth=1)
line_5 = Line(trim_tree_5)

trim_tree_6 = TrimTree(Tree=line_5, Depth=1)

# ----
# Initialize Inputs
travel_feed_rate = Panel("1200")
layer_change_feed_rate = Panel("720")
extrusion_feed_rate = Panel("600")
vase_mode_active = Panel(spiral_vase_mode)
indicated_extrusion_width = Panel(extrusion_width)
vase_mode_bottom_shells = Panel(bottom_shell_layers)
nozzle_diameter = Panel("0.4")
filament_diameter = Panel("1.75")
layer_height_2 = Panel(layer_height)
merge_2 = Merge(Data1=trim_tree_6, Data2=stream_filter_5)

# ----
# Process Geometry and Convert to GCode
# NOTE THAT THIS GCODE OUTPUT ASSUMES:
# - A PRUSA MK3S+ as the Printer
# - PLA Material
# - Extrusion Temperature: 215C
# - Heated Bed Temperature: 60C
python_3_script_generate_gcode = Python3Script(
    lines=flatten(merge_2),
    nozzle_diameter=nozzle_diameter,
    filament_diameter=filament_diameter,
    layer_height=layer_height_2,
    extrusion_width=indicated_extrusion_width,
    travel_feed_rate=travel_feed_rate,
    layer_change_feed_rate=layer_change_feed_rate,
    extrusion_feed_rate=extrusion_feed_rate,
    vaseMode=vase_mode_active,
    numBottomShells=vase_mode_bottom_shells)  # -> out, gcode_output; inputs lines: list of Line, nozzle_diameter: Double, filament_diameter: Double, layer_height: Double, extrusion_width: Double, travel_feed_rate: Double, layer_change_feed_rate: Double, extrusion_feed_rate: Double, vaseMode: Boolean, numBottomShells: Int32
# ---------- python_3_script_generate_gcode: Python ----------
"""
    This file contains parameters, helpers, and setup to 
    create a basic gcode generation algorithm from line segments.
    
    The main 
    
    Inputs:
        lines: the line segments to be converted into gcode commands for extrusion 
        nozzle_diameter: the diameter of the 3D printer's nozzle
        filament_diameter: the diameter of the 3d printing filament
        layer_height: the height of each layer in the print
        extrusion_width: the width of the extruded line from the printer
        travel_feed_rate: the speed at which the extruder moves in X and Y
        layer_change_feed_rate: the speed at which teh extruder moves when 
            changing layers in the Z direction
        extrusion_feed_rate: the speed at which the extruder move when extruding

    Output:
        gcode_output: a string with gcode commands separate by new-lines"""

__author__ = "mrivera-cu"

import rhinoscriptsyntax as rs

import math

print(vaseMode)




########## CONSTANTS BELOW ###############

# GCODE COMMANDS
COMMAND_MOVE = "G1"

# GCODE PARAM NAMES
PARAM_X = "X"
PARAM_Y = "Y"
PARAM_Z = "Z"
PARAM_E = "E"
PARAM_F = "F"

# Separates commands
COMMAND_DELIMITER = "\n"

# Precision for converting floats to strings
E_VALUE_PRECISION = 5
XYZ_VALUE_PRECISION = 3

# Float equality precision
FLOAT_EQUALITY_PRECISION = 5

#### WARNING: DO NOT EDIT THE START GCODE! #####
start_gcode_lines = [";START GCODE",
    "M201 X1000 Y1000 Z200 E5000 ; sets maximum accelerations, mm/sec^2",
    "M203 X200 Y200 Z12 E120 ; sets maximum feedrates, mm / sec",
    "M204 S1250 T1250 ; sets acceleration (S) and retract acceleration (R), mm/sec^2",
    "M205 X8.00 Y8.00 Z0.40 E4.50 ; sets the jerk limits, mm/sec",
    "M205 S0 T0 ; sets the minimum extruding and travel feed rate, mm/sec",
    ";TYPE:Custom",
    "M862.3 P \"MK3S\" ; printer model check",
    "M862.1 P0.4 ; nozzle diameter check",
    "M115 U3.13.3 ; tell printer latest fw version",
    "G90 ; use absolute coordinates",
    "M83 ; extruder relative mode",
    "M104 S215 ; set extruder temp",
    "M140 S60 ; set bed temp",
    "M190 S60 ; wait for bed temp",
    "M109 S215 ; wait for extruder temp",
    "G28 W ; home all without mesh bed level",
    "G80 X86.6877 Y64.7708 W85.2412 H59.1573 ; mesh bed levelling",
    "G1 Z0.2 F720",
    "G1 Y-3 F1000 ; go outside print area",
    "G92 E0",
    "G1 X60 E9 F1000 ; intro line",
    "G1 X100 E12.5 F1000 ; intro line",
    "G92 E0",
    "M221 S95",
    "; Don't change E values below. Excessive value can damage the printer.",
    "M907 E538 ; set extruder motor current",
    "G21 ; set units to millimeters",
    "G90 ; use absolute coordinates",
    "M83 ; use relative distances for extrusion",
    "M900 K0.05 ; Filament gcode LA 1.5",
    "M900 K30 ; Filament gcode LA 1.0",
    "M107"]
    
##### WARNING: DO NOT EDIT THE END GCODE! ######
end_gcode_lines = ["; END Gcode", 
    "M204 S1000", 
    "M107", 
    ";TYPE:Custom", 
    "; Filament-specific end gcode", 
    "G1 Z180 F720 ; Move print head further up", 
    "G1 X0 Y200 F3600 ; park", 
    "G4 ; wait",
    "M221 S100 ; reset flow",
    "M900 K0 ; reset LA",
    "M104 S0 ; turn off temperature",
    "M140 S0 ; turn off heatbed",
    "M107 ; turn off fan",
    "M84 ; disable motors",
    "M73 P100 R0 ; print progress done",
    "M73 Q100 S0 ; print progress done"]

#########################################################################

# Converts a float (f) to a string with some precision of decimal places
# For example: 
# Input: f=0.1234, precision=3 
# Output: "0.123"
def float_to_string(f, precision=XYZ_VALUE_PRECISION): 
    f = float(f)
    str_format = "{value:." + str(precision) +"f}"
    return str_format.format(value=f)
    
# Helper to convert the E value to the proper precision
def e_value_to_string(e):
    return float_to_string(e, E_VALUE_PRECISION)

# Helper to convert the XYZ value to the proper precision
def xyz_value_to_string(e):
    return float_to_string(e, XYZ_VALUE_PRECISION)

#########################################################################

# Helper function to compare floats in grasshopper/python due to float precision errors
def are_floats_equal(f1, f2, epsilon=10**(-FLOAT_EQUALITY_PRECISION)):
    f1 *= 10**FLOAT_EQUALITY_PRECISION
    f2 *= 10**FLOAT_EQUALITY_PRECISION
    return math.fabs(f2 - f1) <= epsilon
    
# Helper function to compare if two points are equal (have the same coordinates)
# by handling float precision comparisons
def is_same_pt(ptA, ptB):
    return are_floats_equal(ptA[0], ptB[0]) and are_floats_equal(ptA[1], ptB[1]) and are_floats_equal(ptA[2], ptB[2])
     
     
########################################################################
# creates a string consisting of a G1 move command and 
# any associated parameters
def gcode_move(current_pos, next_pos, feed_rate=None, should_extrude=False):
    # Start with "G1" as command
    move_command_str = COMMAND_MOVE
    
    # Compare X positions
    if (not are_floats_equal(current_pos[0],next_pos[0])):
        # we have a different x position so add it as a parameter to the command
        x_value = float_to_string(next_pos[0], precision=XYZ_VALUE_PRECISION)
        # Add X<x_value> to move string, e.g., X100.00
        move_command_str += " " + PARAM_X + x_value
    
    # Compare Y positions
    if (not are_floats_equal(current_pos[1], next_pos[1])):
        # we have a different y position so add the new position as a parameter
        y_value = float_to_string(next_pos[1], precision=XYZ_VALUE_PRECISION)
        # Add Y<y_value> to move string, e.g., Y100.00
        move_command_str += " " + PARAM_Y + y_value
    
    # Compare Z position
    if (not are_floats_equal(current_pos[2], next_pos[2])):
        # we have a different z position so add the new position as a parameter
        z_value = float_to_string(next_pos[2], precision=XYZ_VALUE_PRECISION)
        # Add Z<z_value> to move string, e.g., Z100.00
        move_command_str += " " + PARAM_Z + z_value
        print("Z move command: ", move_command_str)
    
    if (should_extrude):
        #requires calculation of E value...
        threeD_distance = math.dist(current_pos, next_pos)
        # Calculate extrusion "slice" area...
        a_out = (layer_height * (extrusion_width - layer_height)) + (math.pi * (layer_height/2)**2)

        v_out = a_out * threeD_distance
        a_in = math.pi * (filament_diameter / 2)**2 # v_in for 1mm. 
        e_factor = v_out/a_in
        e_value = float_to_string(e_factor, precision=E_VALUE_PRECISION)
        move_command_str += " " + PARAM_E + e_value
    
    # See if we have a feedrate to use, and handle it differently than other 
    # parameters as it is an integer value
    if (feed_rate is not None):
        # feed rate is an int
        feed_rate_value = round(feed_rate)
        # Add F<feed_rate_value> to move string, e.g., F2000
        move_command_str += " " + PARAM_F + str(feed_rate_value)   
    
    # Remove excess whitespace on ends
    move_command_str = move_command_str.strip(" ")
    return move_command_str


############################################
############################################
############################################
    
''' Here's the main method of the script that uses the helper methods above '''

def generate_gcode():
    print("Working...")
    current_position = [0, 0, 0]        # start extruder at the origin
    all_move_commands = []              # list to hold for all the move commands

    for i in range(0, len(lines)):
        # Get pts of the line segment
        line = lines[i]
        line_start_position = line.From
        line_end_position = line.To


        
        # Handle layer change (Z-position)
        if not are_floats_equal(line_start_position[2], current_position[2]):
                print("Z has changed...")
                print("current_position[2]: ", current_position[2], " line_start_position[2]", line_start_position[2])
                new_z_pos = [current_position[0], current_position[1], line_start_position[2]]
                layer_change_command = gcode_move(current_position, new_z_pos, feed_rate=layer_change_feed_rate)
                # Append command
                # print("currentPos: ", current_position, " newPos: ", line_start_position)
                all_move_commands.append(layer_change_command)
                current_position = new_z_pos #update position for next command
                # print("New Z Pos: ", new_z_pos)

        # Check if printer coords match start of current line.
        if not is_same_pt(current_position, line_start_position):
            # Move to the the line_start_position
            move_to_line_start_command = gcode_move(current_position, line_start_position, feed_rate=travel_feed_rate)
            # Append command
            all_move_commands.append(move_to_line_start_command)
            current_position = line_start_position
        
        # Once extruder is positioned, begin move command that includes extrusion command
        if is_same_pt(current_position, line_start_position):
            extrude_line_command = gcode_move(current_position, line_end_position, extrusion_feed_rate, True)
            all_move_commands.append(extrude_line_command)
            current_position = line_end_position

    # Combine the `start_gcode`, `all_move_commands`, and `end_gcode` for output
    gcode_lines = start_gcode_lines + all_move_commands + end_gcode_lines

    # --- DO NOT EDIT BELOW ----
    # The takes the combined gcode_lines list and creates a string containing each line
    # separated by a COMMAND_DELIMITER (the new-line character), and sets it 
    # to the `gcode_output`variable of this component
    output = COMMAND_DELIMITER.join(gcode_lines)
    
    return output
    
''' RUN THE MAIN FUNCITON ABOVE - DO NOT EDIT '''
# this sets the gcode commands to be the the `gcode_output` variable of this grasshopper component
gcode_output = generate_gcode()

print(layer_height)
# ---------- end python_3_script_generate_gcode ----------
debugging_panel = Panel(python_3_script_generate_gcode.out)

panel_6 = Panel(python_3_script_generate_gcode.gcode_output)

# ----
# Export GCode w/ Pancake
panel_7 = Panel("/Users/bransonlaszlo/Documents/Classes/Computational Fabrication/L3/catOutput.gcode")
true_only_button = TrueOnlyButton(LastSaveLocalization="neutral,N")
export_txt = ExportTXT(
    Content=python_3_script_generate_gcode.gcode_output,
    FileLocation=panel_7,
    Overwrite=Toggle(True),
    Encoding="utf-8",
    Export=true_only_button,
    LastSaveLocalization="neutral,N")
panel_8 = Panel(export_txt)
