# Grasshopper definition paramFurniture.gh (Grasshopper 1.0.8)
# plug-ins: Bifocals

# ----
# This sketch generates a parametric table with spiraled legs.
# 
# Note: Adjusting certain parameters will break geometry at Solid Union.
# Pay close attention to chamfers.
# Tabletop
length = Slider(40, range=0..60)
width = Slider(60, range=0..60)
corner_radius = Slider(17, range=0..100)
tabletop_height = Slider(7.79, range=0.01..10)
edge_chamfer = Slider(1.53, range=0..10)

# ----
# Legs
leg_position = Slider(14.29, range=0..20)
leg_height = Slider(55, range=0..55)
leg_rotation = Slider(0, range=0..6.5)
spiral_pitch = Slider(49.907, range=0..60)
spiral_radius = Slider(4.678, range=0..10)
leg_pipe_radius = Slider(3.95, range=0..6)
leg_depth = Slider(-3.736, range=-10..0)

# ----
# Feet
# (If legs exceed top face of feet,
#  Solid Union fails)
feet_chamfer = Slider(2.763, range=0..10)
feet_radius = Slider(2.31, range=-10..10)
added_feet_depth = Slider(2.71, range=0..10)

# ----
# Generate Leg Helix
# (https://www.grasshopper3d.com/forum/topics/generating-a-helix)
series = Series(Start=leg_depth, Step=1, Count=spiral_pitch)
cosine = Cosine(Value=series)
sine = Sine(Value=series)
multiplication = Multiplication(A=cosine, B=spiral_radius)
multiplication_2 = Multiplication(A=spiral_radius, B=sine)
construct_point = ConstructPoint(XCoordinate=multiplication, YCoordinate=multiplication_2, ZCoordinate=series)
interpolate = Interpolate(Vertices=construct_point, Degree=3, Periodic=False, KnotStyle=1)  # -> Curve, Length, Domain
box = Box(interpolate.Curve)
deconstruct_box = DeconstructBox(Box=box)  # -> Plane, X, Y, Z
deconstruct_domain = DeconstructDomain(Domain=deconstruct_box.Z)  # -> Start, End

# ----
# Stretch (Ugly) and Pipe Leg
construct_point_2 = ConstructPoint(XCoordinate=0, YCoordinate=0, ZCoordinate=expr("x+.0001", deconstruct_domain.End))
construct_point_3 = ConstructPoint(XCoordinate=0, YCoordinate=0, ZCoordinate=expr("x-.0001", 0))
line = Line(StartPoint=construct_point_3, EndPoint=construct_point_2)
stretch = Stretch(Geometry=interpolate.Curve, Axis=line, Length=leg_height, Rigid=False)
pipe = Pipe(Curve=stretch, Radius=leg_pipe_radius, Caps=1)
volume = Volume(Geometry=pipe)  # -> Volume, Centroid
deconstruct = Deconstruct(Point=volume.Centroid)  # -> XComponent, YComponent, ZComponent
construct_point_4 = ConstructPoint(XCoordinate=deconstruct.XComponent, YCoordinate=deconstruct.YComponent, ZCoordinate=0)

# ----
# Generate Chamfered Tabletop
minimum = Minimum(A=length, B=width)
expression = Expression(x=minimum, r=corner_radius, Expression="x/2 * (r/100)")
rectangle = Rectangle(Plane=PlaneXY(0, 0, 0), XSize=length, YSize=width, Radius=expression)  # -> Rectangle, Length
unit_z = UnitZ(Factor=tabletop_height)
extrude = Extrude(Base=rectangle.Rectangle, Direction=unit_z)
cap_holes = CapHoles(Brep=extrude)
box_2 = Box(cap_holes)
volume_2 = Volume(Geometry=cap_holes)  # -> Volume, Centroid
deconstruct_box_2 = DeconstructBox(Box=box_2)  # -> Plane, X, Y, Z
deconstruct_2 = Deconstruct(Point=volume_2.Centroid)  # -> XComponent, YComponent, ZComponent
construct_point_5 = ConstructPoint(XCoordinate=deconstruct_2.XComponent, YCoordinate=deconstruct_2.YComponent, ZCoordinate=0)
edges_from_faces = EdgesFromFaces(Brep=cap_holes, Points=construct_point_5)  # -> Edges, Indices
fillet_edge = FilletEdge(Shape=cap_holes, Blend=1, Metric=0, Edges=edges_from_faces.Indices, Radii=edge_chamfer)

# ----
# Get Leg Positions
# (Strange behavior…
# Brep | Line intersect requires line isn’t parallel with surface…)
construct_point_6 = ConstructPoint(XCoordinate=length, YCoordinate=width, ZCoordinate=0)
construct_point_7 = ConstructPoint(XCoordinate=0, YCoordinate=0, ZCoordinate=0.001)
construct_point_8 = ConstructPoint(XCoordinate=0, YCoordinate=width, ZCoordinate=0)
construct_point_9 = ConstructPoint(XCoordinate=length, YCoordinate=0, ZCoordinate=0.001)
line_2 = Line(StartPoint=construct_point_6, EndPoint=construct_point_7)
line_3 = Line(StartPoint=construct_point_8, EndPoint=construct_point_9)
brep_line = BrepLine(Brep=cap_holes, Line=[line_2, line_3], LimitToFirst=False)  # -> Curves, Points
point = Point(brep_line.Points)
average = Average(Input=point)
no_longer_used_leg_top_radius = Slider(1.18, range=0..10)
panel = Panel(point)
vector_2pt = Vector2Pt(PointA=point, PointB=average, Unitize=invert(False))  # -> Vector, Length
keep_legs_on_table = Maximum(A=leg_position, B=no_longer_used_leg_top_radius)
multiplication_3 = Multiplication(A=vector_2pt.Vector, B=keep_legs_on_table)
addition = Addition(A=point, B=multiplication_3)
panel_2 = Panel(addition)
deconstruct_3 = Deconstruct(Point=addition)  # -> XComponent, YComponent, ZComponent
unit_z_2 = UnitZ(Factor=Slider(0.001, range=0.001..10))
deconstruct_domain_2 = DeconstructDomain(Domain=deconstruct_box_2.Z)  # -> Start, End
construct_point_10 = ConstructPoint(
    XCoordinate=deconstruct_3.XComponent,
    YCoordinate=deconstruct_3.YComponent,
    ZCoordinate=expr("x-.001", deconstruct_domain_2.End))
circle = Circle(Plane=construct_point_10, Radius=no_longer_used_leg_top_radius)
extrude_2 = Extrude(Base=circle, Direction=unit_z_2)
cap_holes_2 = CapHoles(Brep=extrude_2)
volume_3 = Volume(Geometry=cap_holes_2)  # -> Volume, flatten(Centroid)

# ----
# Mirror Legs For Symmetry
list_item = ListItem(List=volume_3.Centroid, Index=0, Wrap=True)
vector_2pt_2 = Vector2Pt(PointA=construct_point_4, PointB=list_item, Unitize=False)  # -> Vector, Length
move = Move(Geometry=pipe, Motion=vector_2pt_2.Vector)  # -> Geometry, Transform
volume_4 = Volume(Geometry=move.Geometry)  # -> Volume, Centroid
deconstruct_4 = Deconstruct(Point=volume_4.Centroid)  # -> XComponent, YComponent, ZComponent
construct_point_11 = ConstructPoint(XCoordinate=deconstruct_4.XComponent, YCoordinate=deconstruct_4.YComponent, ZCoordinate=0)
volume_5 = Volume(Geometry=box_2)  # -> Volume, Centroid
line_4 = Line(StartPoint=volume_4.Centroid, EndPoint=construct_point_11)
rotate_axis = RotateAxis(Geometry=move.Geometry, Angle=leg_rotation, Axis=line_4)  # -> Geometry, Transform
deconstruct_5 = Deconstruct(Point=volume_5.Centroid)  # -> XComponent, YComponent, ZComponent
construct_point_12 = ConstructPoint(XCoordinate=0, YCoordinate=deconstruct_5.YComponent, ZCoordinate=deconstruct_5.ZComponent)
construct_point_13 = ConstructPoint(XCoordinate=deconstruct_5.XComponent, YCoordinate=0, ZCoordinate=deconstruct_5.ZComponent)
line_5 = Line(StartPoint=volume_5.Centroid, EndPoint=construct_point_13)
line_6 = Line(StartPoint=volume_5.Centroid, EndPoint=construct_point_12)
mirror = Mirror(Geometry=rotate_axis.Geometry, Plane=line_5)  # -> Geometry, Transform
merge = Merge(Data1=rotate_axis.Geometry, Data2=mirror.Geometry)
mirror_2 = Mirror(Geometry=merge, Plane=line_6)  # -> Geometry, Transform
merge_2 = Merge(Data1=mirror_2.Geometry, Data2=merge)

# ----
# Generate Chamfered Feet
box_3 = Box(merge_2)
volume_6 = Volume(Geometry=box_3)  # -> Volume, Centroid
deconstruct_6 = Deconstruct(Point=volume_6.Centroid)  # -> XComponent, YComponent, ZComponent
addition_2 = Addition(A=spiral_radius, B=leg_pipe_radius)
deconstruct_box_3 = DeconstructBox(Box=box_3)  # -> Plane, X, Y, Z
deconstruct_domain_3 = DeconstructDomain(Domain=deconstruct_box_3.Z)  # -> Start, End
expression_2 = Expression(x=leg_pipe_radius, y=deconstruct_domain_3.End, Expression="y-x*2")
addition_3 = Addition(A=deconstruct_domain_3.End, B=added_feet_depth)
construct_point_14 = ConstructPoint(XCoordinate=deconstruct_6.XComponent, YCoordinate=deconstruct_6.YComponent, ZCoordinate=expression_2)
construct_point_15 = ConstructPoint(XCoordinate=deconstruct_6.XComponent, YCoordinate=deconstruct_6.YComponent, ZCoordinate=addition_3)
addition_4 = Addition(A=addition_2, B=feet_radius)
circle_2 = Circle(Plane=construct_point_14, Radius=addition_4)  # -> graft(Circle)
circle_3 = Circle(Plane=construct_point_15, Radius=addition_4)  # -> graft(Circle)
merge_3 = Merge(Data1=circle_3, Data2=circle_2)
panel_3 = Panel(merge_3)
loft = Loft(Curves=merge_3, Options={Adjust=False, Closed=False, LoftEnds=0, LoftSimp=0, LoftType=3, Rebuild=10, Refit=0.01})
cap_holes_3 = CapHoles(Brep=loft)
fillet_edge_2 = FilletEdge(Shape=cap_holes_3, Blend=1, Metric=0, Edges=Slider(1, range=0..1), Radii=feet_chamfer)

# ----
# Solid Union and Rotation
merge_4 = Merge(Data1=flatten(merge_2), Data2=flatten(fillet_edge_2), Data3=flatten(fillet_edge))
solid_union = SolidUnion(Breps=merge_4)
box_4 = Box(solid_union)
volume_7 = Volume(Geometry=box_4)  # -> Volume, Centroid
deconstruct_7 = Deconstruct(Point=volume_7.Centroid)  # -> XComponent, YComponent, ZComponent
construct_point_16 = ConstructPoint(XCoordinate=0, YCoordinate=deconstruct_7.YComponent, ZCoordinate=deconstruct_7.ZComponent)
line_7 = Line(StartPoint=construct_point_16, EndPoint=volume_7.Centroid)
rotate_axis_2 = RotateAxis(Geometry=solid_union, Angle=3.141592654, Axis=line_7)  # -> Geometry, Transform

# ----
# Output
brep = Brep(rotate_axis_2.Geometry)

panel_4 = Panel(merge_4)

# ----
# Get Dimensions
deconstruct_box_4 = DeconstructBox(Box=box_4)  # -> Plane, X, Y, Z
deconstruct_domain_4 = DeconstructDomain(Domain=deconstruct_box_4.Y)  # -> Start, End
deconstruct_domain_5 = DeconstructDomain(Domain=deconstruct_box_4.X)  # -> Start, End
deconstruct_domain_6 = DeconstructDomain(Domain=deconstruct_box_4.Z)  # -> Start, End
construct_point_17 = ConstructPoint(XCoordinate=0, YCoordinate=deconstruct_domain_4.End, ZCoordinate=0)
construct_point_18 = ConstructPoint(XCoordinate=0, YCoordinate=0, ZCoordinate=deconstruct_domain_6.End)
construct_point_19 = ConstructPoint(XCoordinate=0, YCoordinate=0, ZCoordinate=0)
construct_point_20 = ConstructPoint(XCoordinate=deconstruct_domain_5.End, YCoordinate=0, ZCoordinate=0)
line_8 = Line(StartPoint=construct_point_17, EndPoint=construct_point_19)
line_9 = Line(StartPoint=construct_point_20, EndPoint=construct_point_19)
line_10 = Line(StartPoint=construct_point_18, EndPoint=construct_point_19)
line_dimension = LineDimension(Line=line_8, Text="{0:0.00}", Size=2)
line_dimension_2 = LineDimension(Line=line_9, Text="{0:0.00}", Size=2)
line_dimension_3 = LineDimension(Line=line_10, Text="{0:0.00}", Size=2)
